# Grasshopper definition OrigamiSIM_11.gh (Grasshopper 1.0.8)
# plug-ins: MeshEdit Components

# ----
# Anchor Pts to Pts
anchor_pts_input = Point([<point referenced from the Rhino model> x2])
anchor_pts_target = Point([<point referenced from the Rhino model> x2])
anchor_pts_input_2 = Data(anchor_pts_input)
anchor_pts_target_2 = Data(anchor_pts_target)

# ----
# Slide Pts to Crvs
# Slide Pts to Srf
pts_sliding_on_crv_input = Point()
sliding_crvs_target = Curve()
pts_sliding_on_srf_input = Point()
crvs_sliding_on_target_srf_input = Curve()
sliding_srf_target = Surface()
pts_sliding_on_crv_input_2 = Data(pts_sliding_on_crv_input)
sliding_crv_target = Data(sliding_crvs_target)
pts_sliding_on_srf_input_2 = Data(pts_sliding_on_srf_input)
crvs_sliding_on_target_srf_input_2 = Data(crvs_sliding_on_target_srf_input)
sliding_srf_target_2 = Data(sliding_srf_target)

# ----
# Boundary
# Mountain Valley Unassigned
cp_boundary_crvs = Curve(<curve referenced from the Rhino model>)
valley_crvs = Curve()
mountain_crvs = Curve()
unassigned_crvs = Curve()
mountain_crvs_2 = Data(mountain_crvs)
unassigned_crvs_2 = Data(unassigned_crvs)
# SIMULATION PARAMETERS
data = Data(cp_boundary_crvs)
valley_crvs_2 = Data(valley_crvs)

# ----
# Glue Pts to Pts
# Glue Crvs to Crvs
# (Crvs directions matter)
pts_to_glue_input = Point()
pts_to_glue_target = Point()
crvs_to_glue_input = Curve(graft([<curve referenced from the Rhino model> x2]))
crvs_to_glue_target = Curve(graft([<curve referenced from the Rhino model> x2]))
crvs_to_glue_input_2 = Data(crvs_to_glue_input)
pts_to_glue_input_2 = Data(pts_to_glue_input)
pts_to_glue_target_2 = Data(pts_to_glue_target)
crvs_to_glue_target_2 = Data(crvs_to_glue_target)

# ----
# Planar Crvs
# Shrinking string
strings_list_of_straight_segments = Curve()
planar_crvs = Curve()
planar_crvs_2 = Data(planar_crvs)
strings = Data(strings_list_of_straight_segments)

# ----
# START HERE:
# if the software asks for the kangaroo .dll usually it's in this path:
# C:\Program Files\Rhino 7\Plug-ins\Grasshopper\Components\KangarooSolver.dll
# CREASE PATTERN
# AND CONSTRAINTS
# clear ALL
# inputs
button = Button()
python_3_script = Python3Script(btn=button)  # -> out, a; inputs btn: Boolean
# ---------- python_3_script: Python ----------
import Grasshopper as gh
import scriptcontext as sc
from Grasshopper.Kernel import GH_ObjectEventType

# ---- keys (per evitare doppie esecuzioni) ----
KEY_REQ  = "cpd_req_"  + str(ghenv.Component.InstanceGuid)
KEY_TRY  = "cpd_try_"  + str(ghenv.Component.InstanceGuid)
KEY_LAST = "cpd_last_" + str(ghenv.Component.InstanceGuid)

MAX_TRIES = 25      # 25 * 100ms = ~2.5s
RETRY_MS  = 100
FIRST_MS  = 50

def pd_nonempty_params(doc):
    """Ritorna lista parametri con PersistentDataCount > 0."""
    lst = []
    for o in list(doc.Objects):
        if hasattr(o, "PersistentData") and hasattr(o, "PersistentDataCount"):
            try:
                if int(o.PersistentDataCount) > 0:
                    lst.append(o)
            except:
                pass
    return lst

def clear_param_completely(p):
    """Clear persistent + clear volatile + rebuild volatile state."""
    # Clear persistent
    p.RecordUndoEvent("Clear Persistent Data")
    p.PersistentData.Clear()                      # PersistentData property [web:38]
    p.OnObjectChanged(GH_ObjectEventType.PersistentData)

    # Clear volatile cache
    try:
        p.ClearData()
    except:
        pass

    # Rebuild (se non ha sorgenti e PD è vuoto, dovrebbe restare vuoto) [web:142]
    try:
        p.CollectData()
        p.ComputeData()
    except:
        pass

    # Expire preview/solution and downstream to remove “ghost” preview [web:147]
    try:
        p.ExpirePreview(True)
    except:
        pass
    try:
        p.ExpireSolution(False)  # assicura cache erased + downstream expired (impl base) [web:147]
    except:
        pass

def expire_downstream(params):
    """Prova ad expiring downstream esplicitamente (se disponibile)."""
    for p in params:
        try:
            # alcuni oggetti espongono ExpireDownStreamObjects (metodo non sempre visibile in CPython)
            p.ExpireDownStreamObjects()
        except:
            pass

doc = ghenv.Component.OnPingDocument()
pressed = bool(btn)

if pressed and doc:
    # Arma richiesta
    sc.sticky[KEY_REQ] = True
    sc.sticky[KEY_TRY] = 0
    sc.sticky[KEY_LAST] = "Requested..."

    def _cb(d):
        if not sc.sticky.get(KEY_REQ, False):
            return

        tries = int(sc.sticky.get(KEY_TRY, 0))
        targets = pd_nonempty_params(d)

        # aspetta internalizzazione
        if len(targets) == 0 and tries < MAX_TRIES:
            sc.sticky[KEY_TRY] = tries + 1
            d.ScheduleSolution(RETRY_MS, gh.Kernel.GH_Document.GH_ScheduleDelegate(_cb))  # schedule semantics [web:70]
            return

        # clear
        for p in targets:
            try:
                clear_param_completely(p)
            except:
                pass

        # expire downstream (ridondante ma utile per alcune catene)
        expire_downstream(targets)

        # chiudi richiesta
        sc.sticky[KEY_REQ] = False
        sc.sticky[KEY_TRY] = 0
        sc.sticky[KEY_LAST] = "Cleared {} params (pd_nonempty was {}).".format(len(targets), len(targets))

        # una sola soluzione finale per aggiornare tutto (fuori dalla soluzione che ha internalizzato) [web:70]
        d.NewSolution(False)

    doc.ScheduleSolution(FIRST_MS, gh.Kernel.GH_Document.GH_ScheduleDelegate(_cb))  # [web:70]
    a = sc.sticky.get(KEY_LAST, "Requested...")
else:
    a = sc.sticky.get(KEY_LAST, "Idle")
# ---------- end python_3_script ----------

# ----
# clear SELECTED
# inputs
button_2 = Button()
python_3_script_2 = Python3Script(btn=button_2)  # -> out, a; inputs btn: Boolean
# ---------- python_3_script_2: Python ----------
import Grasshopper as gh
import scriptcontext as sc
from Grasshopper.Kernel import GH_ObjectEventType

KEY_REQ  = "cpd_sel_req_"  + str(ghenv.Component.InstanceGuid)
KEY_TRY  = "cpd_sel_try_"  + str(ghenv.Component.InstanceGuid)
KEY_LAST = "cpd_sel_last_" + str(ghenv.Component.InstanceGuid)

MAX_TRIES = 25
RETRY_MS  = 100
FIRST_MS  = 50

def selected_objects(doc):
    sel = []
    for o in list(doc.Objects):
        at = getattr(o, "Attributes", None)  # IGH_DocumentObject.Attributes [web:157]
        if at and getattr(at, "Selected", False):
            sel.append(o)
    return sel

def pd_nonempty_selected(doc):
    lst = []
    for o in selected_objects(doc):
        if hasattr(o, "PersistentData") and hasattr(o, "PersistentDataCount"):
            try:
                if int(o.PersistentDataCount) > 0:
                    lst.append(o)
            except:
                pass
    return lst

def clear_param_completely(p):
    # PersistentData è dei parametri persistenti (GH_PersistentParam<T>) [web:38]
    p.RecordUndoEvent("Clear Persistent Data")
    p.PersistentData.Clear()
    p.OnObjectChanged(GH_ObjectEventType.PersistentData)

    # volatile/cache
    try: p.ClearData()
    except: pass

    # rebuild volatile state (se PD vuoto e senza sorgenti -> vuoto) [web:142]
    try:
        p.CollectData()
        p.ComputeData()
    except:
        pass

    # expire preview/solution/downstream (metodi IGH_DocumentObject) [web:157]
    try: p.ExpirePreview(True)
    except: pass
    try: p.ExpireSolution(False)
    except: pass
    try: p.ExpireDownStreamObjects()
    except: pass

doc = ghenv.Component.OnPingDocument()
pressed = bool(btn)

if pressed and doc:
    sc.sticky[KEY_REQ] = True
    sc.sticky[KEY_TRY] = 0
    sc.sticky[KEY_LAST] = "Requested (selected only)..."

    def _cb(d):
        if not sc.sticky.get(KEY_REQ, False):
            return

        sel = selected_objects(d)
        tries = int(sc.sticky.get(KEY_TRY, 0))

        # se non hai selezionato nulla, esci subito
        if len(sel) == 0:
            sc.sticky[KEY_REQ] = False
            sc.sticky[KEY_TRY] = 0
            sc.sticky[KEY_LAST] = "Nothing selected."
            return

        targets = pd_nonempty_selected(d)

        # aspetta internalizzazione solo sugli oggetti selezionati
        if len(targets) == 0 and tries < MAX_TRIES:
            sc.sticky[KEY_TRY] = tries + 1
            d.ScheduleSolution(RETRY_MS, gh.Kernel.GH_Document.GH_ScheduleDelegate(_cb))  # [web:70]
            return

        # clear sui target
        cleared = 0
        for p in targets:
            try:
                clear_param_completely(p)
                cleared += 1
            except:
                pass

        sc.sticky[KEY_REQ] = False
        sc.sticky[KEY_TRY] = 0
        sc.sticky[KEY_LAST] = "Cleared {} selected params (targets={}).".format(cleared, len(targets))

        # una soluzione finale per aggiornare anteprime downstream [web:70]
        d.NewSolution(False)

    doc.ScheduleSolution(FIRST_MS, gh.Kernel.GH_Document.GH_ScheduleDelegate(_cb))  # [web:70]
    a = sc.sticky.get(KEY_LAST, "Requested...")
else:
    a = sc.sticky.get(KEY_LAST, "Idle")
# ---------- end python_3_script_2 ----------

fold_ease = Slider(43, range=1..100)

# ----
# FOLDING
# MESH STIFFNESS
fold_strenght = ValueList({"off": 0, "low": 50, "medium": 200, "high": 600, "ultra": 1000}, selected="medium")
stretching_stiffness = ValueList({"off": 0, "low": 50, "medium": 5000, "high": 10000, "ultra": 100000}, selected="medium")
srf_bending_stiffness = ValueList({"off": 0, "low": 7, "medium": 50, "high": 1000}, selected="high")
crvs_bending_stiffness = ValueList({"off": 0, "low": 50, "medium": 200, "high": 1000}, selected="off")
fold_amount = Slider(1, range=0..1)
fold_angle_division = Slider(1, range=1..5)
fold_strenght_activation_delay = Slider(50, range=1..100)
division = Division(A=fold_amount, B=fold_angle_division)
fold_amount_2 = Data(division)
fold_strenght_2 = Data(fold_strenght_activation_delay)
fold_strenght_3 = Data(fold_ease)
stretching_stiffness_2 = Data(stretching_stiffness)
crvs_bending_stiffness_2 = Data(crvs_bending_stiffness)
bending_stiffness = Data(srf_bending_stiffness)

string_ease = Slider(1, range=1..100)
fold_strenght_4 = Data(fold_strenght)
fold_strenght_5 = Data(string_ease)

material = CreateMaterial(
    Diffuse=ColourSwatch(SwatchColor=RGB(60, 255, 0)),
    Specular=RGB(255, 255, 255),
    Emission=RGB(0, 0, 0),
    Transparency=Slider(0.8, range=0..1),
    Shine=0)

cp_boundary_crvs_2 = Data(data)
mountain_crvs_3 = Data(mountain_crvs_2)
valley_crvs_3 = Data(valley_crvs_2)
unassigned_crvs_3 = Data(unassigned_crvs_2)
crvs_to_glue_input_3 = Data(crvs_to_glue_input_2)
crvs_to_glue_target_3 = Data(crvs_to_glue_target_2)
crvs_sliding_on_target_srf_input_3 = Data(crvs_sliding_on_target_srf_input_2)
pts_to_glue_input_3 = Data(pts_to_glue_input_2)
pts_to_glue_target_3 = Data(pts_to_glue_target_2)
anchor_pts_input_3 = Data(anchor_pts_input_2)
pts_sliding_on_crv_input_3 = Data(pts_sliding_on_crv_input_2)
pts_sliding_on_srf_input_3 = Data(pts_sliding_on_srf_input_2)
strings_2 = Data(strings)
planar_crvs_3 = Data(planar_crvs_2)

# ---- group: merge all relevant points
end = EndPoints(Curve=strings_2)  # -> Start, End
merge = Merge(
    Data1=pts_to_glue_input_3,
    Data2=pts_to_glue_target_3,
    Data3=anchor_pts_input_3,
    Data4=pts_sliding_on_crv_input_3,
    Data5=pts_sliding_on_srf_input_3,
    Data6=[end.Start, end.End])  # -> flatten(Result)
input_anchor_pts_merged = Data(merge)

# ---- group: explode all curves
explode = Explode(Curve=cp_boundary_crvs_2, Recursive=True)  # -> Segments, Vertices
explode_2 = Explode(Curve=mountain_crvs_3, Recursive=True)  # -> Segments, Vertices
explode_3 = Explode(Curve=valley_crvs_3, Recursive=True)  # -> Segments, Vertices
explode_4 = Explode(Curve=unassigned_crvs_3, Recursive=True)  # -> Segments, Vertices
explode_5 = Explode(Curve=crvs_to_glue_input_3, Recursive=True)  # -> Segments, Vertices
explode_6 = Explode(Curve=crvs_to_glue_target_3, Recursive=True)  # -> Segments, Vertices
explode_7 = Explode(Curve=crvs_sliding_on_target_srf_input_3, Recursive=True)  # -> Segments, Vertices

# ---- group: merge all cutting curves
merge_2 = Merge(
    Data1=explode.Segments,
    Data3=explode_2.Segments,
    Data4=explode_3.Segments,
    Data5=explode_4.Segments,
    Data6=explode_5.Segments,
    Data7=explode_6.Segments,
    Data8=explode_7.Segments,
    Data9=planar_crvs_3)  # -> flatten(Result)

# ---- group: split mountain
cluster = Cluster_2(crvs_to_cut=explode_2.Segments, cutting_crvs=merge_2, cutting_pts=input_anchor_pts_merged)

# ---- group: split valley
cluster_2 = Cluster_2(crvs_to_cut=explode_3.Segments, cutting_crvs=merge_2, cutting_pts=input_anchor_pts_merged)

# ---- group: split crvs sliding on target srf
cluster_3 = Cluster_2(crvs_to_cut=explode_7.Segments, cutting_crvs=merge_2, cutting_pts=input_anchor_pts_merged)

# ---- group: split bounds
cluster_4 = Cluster_2(crvs_to_cut=explode.Segments, cutting_crvs=merge_2, cutting_pts=input_anchor_pts_merged)

# ---- group: split input crvs to glue
cluster_5 = Cluster_2(crvs_to_cut=explode_5.Segments, cutting_crvs=merge_2, cutting_pts=input_anchor_pts_merged)

# ---- group: split target crvs to glue
cluster_6 = Cluster_2(crvs_to_cut=explode_6.Segments, cutting_crvs=merge_2, cutting_pts=input_anchor_pts_merged)

# ---- group: split planar crvs
cluster_7 = Cluster_2(crvs_to_cut=planar_crvs_3, cutting_crvs=merge_2, cutting_pts=input_anchor_pts_merged)

# ---- group: split unassigned
cluster_8 = Cluster_2(crvs_to_cut=explode_4.Segments, cutting_crvs=merge_2, cutting_pts=input_anchor_pts_merged)

# ---- group: assign paths to retrieve branches easily
data_2 = Data(flatten(cluster))
path_mapper = PathMapper(data_2, source="{A}", target="{30000}")
data_3 = Data(flatten(cluster_3))
path_mapper_2 = PathMapper(data_3, source="{A}", target="{80000}")
flatten = FlattenTree(Tree=cluster_7, Path="{0}")
path_mapper_3 = PathMapper(flatten, source="{A}", target="{90000}")
data_4 = Data(flatten(cluster_5))
path_mapper_4 = PathMapper(data_4, source="{A}", target="{60000}")
data_5 = Data(flatten(cluster_8))
path_mapper_5 = PathMapper(data_5, source="{A}", target="{50000}")
data_6 = Data(flatten(cluster_6))
path_mapper_6 = PathMapper(data_6, source="{A}", target="{70000}")
data_7 = Data(flatten(cluster_4))
path_mapper_7 = PathMapper(data_7, source="{A}", target="{10000}")
data_8 = Data(flatten(cluster_2))
path_mapper_8 = PathMapper(data_8, source="{A}", target="{40000}")

# ---- group: all split curves merged
merge_3 = Merge(
    Data1=path_mapper_7,
    Data3=path_mapper,
    Data4=path_mapper_8,
    Data5=path_mapper_5,
    Data6=path_mapper_4,
    Data7=path_mapper_6,
    Data8=path_mapper_2,
    Data9=path_mapper_3)  # -> simplify(Result)

# ---- group: split closed curves into 4 segments
# to prevent closed curved holes to
# colapse in case of coarse mesh
py3 = Python3Script(curves=merge_3)  # -> out, splitSegments; inputs curves: tree of Curve
# ---------- py3: Python ----------
from Grasshopper import DataTree
from Grasshopper.Kernel.Data import GH_Path
import Rhino.Geometry as rg

# Output tree
splitSegments = DataTree[object]()

# Normalized parameters to split at
t_values = [0.0, 0.25, 0.5, 0.75]

# Loop through all branches in the input tree
for i in range(curves.BranchCount):
    path = curves.Path(i)
    branch = curves.Branch(path)

    for crv in branch:
        if crv and crv.IsClosed:
            # Reparametrize the curve to [0,1]
            crv.Domain = rg.Interval(0.0, 1.0)

            # Get actual curve parameters at normalized locations
            split_params = [crv.Domain.ParameterAt(t) for t in t_values]

            # Get parameter values using closest point to ensure accuracy
            params = [crv.ClosestPoint(crv.PointAt(t))[1] for t in split_params]

            # Split the curve at these parameters
            segments = crv.Split(params)

            if segments:
                for seg in segments:
                    splitSegments.Add(seg, path)
        else:
            # If not a closed curve, add it as-is
            splitSegments.Add(crv, path)
# ---------- end py3 ----------
all_input_crvs = Data(py3.splitSegments)

# ----
# Grab
grab = Grab(On=True, Strength=100, Range=30)

pts_sliding_on_crv_input_4 = Data(pts_sliding_on_crv_input_2)
pts_sliding_on_srf_input_4 = Data(pts_sliding_on_srf_input_2)
sliding_crv_target_2 = Data(sliding_crv_target)

# ----
# Mesh density
mesh_density = Slider(50, range=0..1000)
pts_merging_threshold = DigitScroller(Scroller_Digits=12, Scroller_Prefix="Pts merging threshold", Scroller_Radix=9, Scroller_Value=0.001)
mesh_density_multiplier_on_crvs = Slider(1.5, range=1..20)
relax_mesh = BooleanToggle(True)
mesh_density_multiplier_on_crvs_2 = Data(mesh_density_multiplier_on_crvs)
relax_mesh_toggle = Data(relax_mesh)
mesh_density_2 = Data(mesh_density)
pts_merging_threshold_2 = Data(pts_merging_threshold)

# ---- group: populate with points
# SPLIT AND DISCRETIZE ALL CP CRVS
# AND MERGE POINTS WITHIN A TOLERANCE
# populate CP with points
boundary = BoundarySurfaces(Edges=flatten(explode.Segments))
mesh_density_3 = Data(mesh_density_2)
popgeo = PopulateGeometry(Geometry=boundary, Count=mesh_density_3, Seed=1)

# ---- group: average distance between points
del = DelaunayMesh(Points=popgeo, Plane=PlaneXY(0, 0, 0))
medges = MeshEdges(Mesh=del)  # -> NakedEdges, InteriorEdges, NonManifoldEdges
len = Length(Curve=medges.InteriorEdges)
avr = Average(Input=len)

# ---- group: average distance between points / very very big numer for Crvs division in case of 0 density of points
merge_4 = Merge(Data1=avr, Data2=Slider(10000, range=0..10000))  # -> flatten(Result)
bnd = Bounds(Numbers=merge_4)
dedomain = DeconstructDomain(Domain=bnd)  # -> Start, End
average_pts_dist = Data(dedomain.Start)

# ---- group: divide lines based on distance between points
average_pts_dist_2 = Data(average_pts_dist)
all_input_crvs_2 = Data(all_input_crvs)
mesh_density_multiplier_on_crvs_3 = Data(mesh_density_multiplier_on_crvs_2)
len_2 = Length(Curve=all_input_crvs_2)
division_2 = Division(A=average_pts_dist_2, B=mesh_density_multiplier_on_crvs_3)
division_3 = Division(A=len_2, B=division_2)
int = Integer(division_3)
divide = DivideCurve(Curve=all_input_crvs_2, Count=int, Kinks=False)  # -> Points, Tangents, Parameters

# ---- group: erase pts close to the ref crvs
all_creases_and_bounds = Data(py3.splitSegments)
populated_points = Data(graft(popgeo))
average_pts_dist_3 = Data(average_pts_dist)
flatten_2 = FlattenTree(Tree=all_creases_and_bounds, Path="{0}")
crv_cp = CurveClosestPoint(Point=populated_points, Curve=flatten_2)  # -> Point, Parameter, Distance
clean = CleanTree(RemoveNulls=True, RemoveInvalid=True, RemoveEmpty=False, Tree=crv_cp.Distance)
sort = SortList(Keys=clean, ValuesA=clean)  # -> Keys, ValuesA
smaller = SmallerThan(FirstNumber=sort.Keys, SecondNumber=expr("x*0.6", average_pts_dist_3))  # -> SmallerThan, OrEqualTo
item = ListItem(List=smaller.OrEqualTo, Index=0, Wrap=True)
cull = CullPattern(List=populated_points, CullPattern=invert(item))
points_far_from_creases = Data(flatten(cull))

# ---- group: remove first and last point of every segment
lng = ListLength(List=divide.Points)  # -> expr("x-1", simplify(Length))
crossref = CrossReference(ListA="0", ListB=lng, CrossMode=1)  # -> ListA, ListB
merge_5 = Merge(Data1=crossref.ListA, Data2=crossref.ListB)
cull_i = CullIndex(List=divide.Points, Indices=merge_5, Wrap=True)
shift_paths = ShiftPaths(Data=cull_i, Offset=-1)

# ---- group: add back start and end points, in case of zero divisions
all_input_crvs_3 = Data(all_input_crvs)
end_2 = EndPoints(Curve=graft(all_input_crvs_3))  # -> Start, End
merge_6 = Merge(Data1=end_2.Start, Data2=shift_paths, Data3=end_2.End)
ponts_on_each_crv = Data(merge_6)

# ---- group: snap points closer to a certain threshold to fix eventual tolerance issues in the input curves
merge_points_closer_than_this = Data(pts_merging_threshold_2)
ponts_on_each_crv_2 = Data(ponts_on_each_crv)
ms = MagnetSnap(Points=ponts_on_each_crv_2, Range=merge_points_closer_than_this, Strength=10)
onplane = OnPlane(Points=ponts_on_each_crv_2, Plane=PlaneXY(0, 0, 0), Strength=1000)
show = Show(G=ponts_on_each_crv_2)
zombiesolver = ZombieSolver(GoalObjects=[ms, show, onplane], Threshold=1e-10, Tolerance=0.0001, MaxIterations=50000)  # -> I, V, O
clean_2 = CleanTree(RemoveNulls=True, RemoveInvalid=True, RemoveEmpty=True, Tree=zombiesolver.O)  # -> flatten(Tree)

# ---- group: restructure tree
flattened_tree = Data(clean_2)
ref_tree = Data(ponts_on_each_crv_2)
lng_2 = ListLength(List=ref_tree)  # -> flatten(Length)
partition = PartitionList(List=flattened_tree, Size=lng_2)
restructured_tree = Data(partition)
match = MatchTree(Tree=restructured_tree, Guide=ref_tree)

# ---- group: erase pts close to ref pts
cps = ClosestPoints(Point=input_anchor_pts_merged, Cloud=points_far_from_creases, Count=10)  # -> ClosestPoint, CPIndex, Distance
sort_2 = SortList(Keys=cps.Distance, ValuesA=cps.CPIndex)  # -> Keys, ValuesA
smaller_2 = SmallerThan(FirstNumber=sort_2.Keys, SecondNumber=expr("x*0.6", average_pts_dist_3))  # -> SmallerThan, OrEqualTo
cull_2 = CullPattern(List=sort_2.ValuesA, CullPattern=smaller_2.OrEqualTo)  # -> flatten(List)
cull_i_2 = CullIndex(List=points_far_from_creases, Indices=flatten(cull_2), Wrap=True)

# ---- group: extract Crvs by type after split
pline = PolyLine(Vertices=match, Closed=False)
pshift = ShiftPaths(Data=pline, Offset=-1)
pshift_2 = ShiftPaths(Data=pline, Offset=-1)
pshift_3 = ShiftPaths(Data=pline, Offset=-1)
pshift_4 = ShiftPaths(Data=pline, Offset=-1)
pshift_5 = ShiftPaths(Data=pline, Offset=-1)
path = ConstructPath(Indices="10000")
pshift_6 = ShiftPaths(Data=pline, Offset=-1)
pshift_7 = ShiftPaths(Data=pline, Offset=-1)
path_2 = ConstructPath(Indices="30000")
pshift_8 = ShiftPaths(Data=pline, Offset=-1)
path_3 = ConstructPath(Indices="40000")
path_4 = ConstructPath(Indices="50000")
path_5 = ConstructPath(Indices="60000")
path_6 = ConstructPath(Indices="70000")
path_7 = ConstructPath(Indices="80000")
path_8 = ConstructPath(Indices="90000")
branch = TreeBranch(Tree=pshift_3, Path=path_3, MaintainPaths=True)
explode_8 = Explode(Curve=branch, Recursive=True)  # -> Segments, Vertices
branch_2 = TreeBranch(Tree=pshift_2, Path=path_2, MaintainPaths=True)
explode_9 = Explode(Curve=branch_2, Recursive=True)  # -> Segments, Vertices
branch_3 = TreeBranch(Tree=pshift, Path=path, MaintainPaths=True)
explode_10 = Explode(Curve=branch_3, Recursive=True)  # -> Segments, Vertices
branch_4 = TreeBranch(Tree=pshift_4, Path=path_4, MaintainPaths=True)
explode_11 = Explode(Curve=branch_4, Recursive=True)  # -> Segments, Vertices
branch_5 = TreeBranch(Tree=pshift_5, Path=path_5, MaintainPaths=True)
explode_12 = Explode(Curve=branch_5, Recursive=True)  # -> Segments, Vertices
branch_6 = TreeBranch(Tree=pshift_6, Path=path_7, MaintainPaths=True)
branch_7 = TreeBranch(Tree=pshift_7, Path=path_6, MaintainPaths=True)
explode_13 = Explode(Curve=branch_7, Recursive=True)  # -> Segments, Vertices
explode_14 = Explode(Curve=branch_6, Recursive=True)  # -> Segments, Vertices
branch_8 = TreeBranch(Tree=pshift_8, Path=path_8, MaintainPaths=True)
explode_15 = Explode(Curve=branch_8, Recursive=True)  # -> Segments, Vertices

# ---- group: if anchor points are none then chose previous points
group = Group(Geometry=cull_i_2)
null = NullItem(Item=cull_2)  # -> NullFlags, InvalidFlags, Description
group_2 = Group(Geometry=points_far_from_creases)
p_n_c = PickNChoose(Pattern=null.NullFlags, Stream0=group, Stream1=group_2)
ungroup = Ungroup(Group=p_n_c)
pts_far_from_crvs_and_other_pts = Data(ungroup)

# ---- group: extract Crvs by type after split / reconstructed crvs sliding on target srf
crvs_sliding_on_target_srf_input__discre = Data(explode_14.Segments)  # "Crvs sliding on target Srf (input) _discrete (Split Crvs)"
crvs_sliding_on_target_srf_input__discre_2 = Data(explode_14.Vertices)  # "Crvs sliding on target Srf (input) _discrete (Pts)"

# ---- group: extract Crvs by type after split / reconstructed target crvs to glue
crvs_to_glue_target__discrete_split_crvs = Data(explode_13.Segments)
crvs_to_glue_target__discrete_pts = Data(explode_13.Vertices)

# ---- group: extract Crvs by type after split / reconstructed input crvs to glue
crvs_to_glue_input__discrete_split_crvs = Data(explode_12.Segments)
crvs_to_glue_input__discrete_pts = Data(explode_12.Vertices)

# ---- group: extract Crvs by type after split / reconstructed planar crvs
planar_crvs_discrete_joined_crvs_tree = Data(branch_8)
planar_crvs_discrete_split_crvs = Data(explode_15.Segments)
planar_crvs_discrete_pts = Data(explode_15.Vertices)

# ---- group: extract Crvs by type after split / reconstructed unassigned
unassigned_discrete_split_crvs = Data(explode_11.Segments)
unassigned_discrete_pts = Data(explode_11.Vertices)

# ---- group: extract Crvs by type after split / reconstructed bounds
boundary__discrete_split_crvs = Data(explode_10.Segments)
boundary__discrete_pts = Data(explode_10.Vertices)

# ---- group: extract Crvs by type after split / reconstructed mountain
mountain_discrete_split_crvs = Data(explode_9.Segments)
mountain_discrete_pts = Data(explode_9.Vertices)

# ---- group: extract Crvs by type after split / reconstructed valley
valley_discrete_split_crvs = Data(explode_8.Segments)
valley_discrete_pts = Data(explode_8.Vertices)

# ---- group: All Crvs to constrain in delaunay
merge_7 = Merge(
    Data1=boundary__discrete_split_crvs,
    Data2=mountain_discrete_split_crvs,
    Data3=valley_discrete_split_crvs,
    Data4=unassigned_discrete_split_crvs,
    Data5=crvs_to_glue_input__discrete_split_crvs,
    Data6=crvs_to_glue_target__discrete_split_crvs,
    Data7=crvs_sliding_on_target_srf_input__discre,
    Data8=planar_crvs_discrete_split_crvs)
all_input_crvs_split = Data(merge_7)

# ---- group: if any curve is on boundary cull that curve
boundary__discrete_split_crvs_2 = Data(boundary__discrete_split_crvs)
all_input_crvs_split_2 = Data(all_input_crvs_split)
midpt = CurveMiddle(Curve=boundary__discrete_split_crvs_2)  # -> flatten(Midpoint)
flatten_3 = FlattenTree(Tree=all_input_crvs_split_2, Path="{0}")
midpt_2 = CurveMiddle(Curve=flatten_3)  # -> flatten(Midpoint)
cp = ClosestPoint(Point=midpt_2, Cloud=midpt)  # -> ClosestPoint, CPIndex, Distance
larger = LargerThan(FirstNumber=cp.Distance, SecondNumber=1e-05)  # -> LargerThan, OrEqualTo
cull_3 = CullPattern(List=flatten_3, CullPattern=larger.OrEqualTo)

# ---- group: Delaunay constrained Pts
merge_8 = Merge(
    Data1=boundary__discrete_pts,
    Data2=mountain_discrete_pts,
    Data3=valley_discrete_pts,
    Data4=unassigned_discrete_pts,
    Data5=crvs_to_glue_input__discrete_pts,
    Data6=crvs_to_glue_target__discrete_pts,
    Data7=crvs_sliding_on_target_srf_input__discre_2,
    Data8=planar_crvs_discrete_pts)
ponts_on_each_crv_3 = Data(merge_8)

# ---- group: remove points on curves for delaunay
# CREATE MESH (CDT)
# AND CONSTRAINED RELAXATION
input_anchor_pts_merged_2 = Data(merge)
pts_on_each_crv = Data(ponts_on_each_crv_3)
cp_2 = ClosestPoint(Point=flatten(input_anchor_pts_merged_2), Cloud=flatten(pts_on_each_crv))  # -> ClosestPoint, CPIndex, Distance
larger_2 = LargerThan(FirstNumber=cp_2.Distance, SecondNumber=0.1)  # -> LargerThan, OrEqualTo
cull_4 = CullPattern(List=input_anchor_pts_merged_2, CullPattern=larger_2.OrEqualTo)

# ----
# CONSTRAINED DELAUNAY
# TRIANGULATION
boundary__discrete_split_crvs_3 = Data(boundary__discrete_split_crvs)
pts_far_from_crvs_and_other_pts_2 = Data(pts_far_from_crvs_and_other_pts)
merge_9 = Merge(Data1=pts_far_from_crvs_and_other_pts_2, Data2=cull_4)
cullpt = CullDuplicates(Points=flatten(merge_9), Tolerance=0.001, CullMode=1)  # -> Points, Indices, Valence
crv = Curve([cull_3, boundary__discrete_split_crvs_3])
pt = Point(cullpt.Points)
c_script = CSharpScript(x=flatten(pt), y=flatten(crv))  # -> out, A; inputs x: list of Point3d, y: list of Polyline
# ---------- c_script: C# ----------
// Grasshopper Script Instance
#region Usings
using System;
using System.Linq;
using System.Collections;
using System.Collections.Generic;
using System.Drawing;

using Rhino;
using Rhino.Geometry;

using Grasshopper;
using Grasshopper.Kernel;
using Grasshopper.Kernel.Data;
using Grasshopper.Kernel.Types;
#endregion

public class Script_Instance : GH_ScriptInstance
{
    #region Notes
    /* 
      Members:
        RhinoDoc RhinoDocument
        GH_Document GrasshopperDocument
        IGH_Component Component
        int Iteration

      Methods (Virtual & overridable):
        Print(string text)
        Print(string format, params object[] args)
        Reflect(object obj)
        Reflect(object obj, string method_name)
    */
    #endregion

    private void RunScript(List<Point3d> x, List<Polyline> y, ref object A)
    {
    A = Mesh.CreateFromTessellation(x, y, Plane.WorldXY, false);
    }
}
# ---------- end c_script ----------
cdt_mesh = Data(c_script.A)

# ----
# REMOVE FACES FROM HOLES
boundary__discrete_split_crvs_4 = Data(boundary__discrete_split_crvs)
cdt_mesh_2 = Data(cdt_mesh)
join = JoinCurves(Curves=flatten(boundary__discrete_split_crvs_4), Preserve=False)
demesh = DeconstructMesh(Mesh=cdt_mesh_2)  # -> Vertices, Faces, Colours, Normals
faceb = FaceBoundaries(Mesh=cdt_mesh_2)
area = Area(Geometry=faceb)  # -> Area, Centroid
boundary_2 = BoundarySurfaces(Edges=join)
pull = PullPoint(Point=area.Centroid, Geometry=boundary_2, ClosestOnly=True)  # -> ClosestPoint, Distance, Index
smaller_3 = SmallerThan(FirstNumber=pull.Distance, SecondNumber=Slider(1e-08, range=0..1e-08))  # -> SmallerThan, OrEqualTo
cull_5 = CullPattern(List=demesh.Faces, CullPattern=smaller_3.SmallerThan)
conmesh = ConstructMesh(Vertices=demesh.Vertices, Faces=cull_5)
cdt_mesh_with_holes = Mesh(conmesh)

# ----
# RELAX MESH
ponts_on_each_crv_4 = Data(ponts_on_each_crv_3)
input_pts_merged = Data(input_anchor_pts_merged)
pts_merging_threshold_3 = Data(pts_merging_threshold_2)
threshold = Slider(0.01, range=0..0.01)
max_iterations = Slider(50000, range=0..100000)
mesh_stiffness = Slider(0.3, range=0..1)
cdt_mesh_with_holes_2 = Mesh(cdt_mesh_with_holes)
merge_10 = Merge(Data1=ponts_on_each_crv_4, Data2=input_pts_merged)
cullpt_2 = CullDuplicates(Points=merge_10, Tolerance=0.1, CullMode=3)  # -> flatten(Points), Indices, Valence
mesh_stiffness_2 = Data(mesh_stiffness)
max_iterations_2 = Data(max_iterations)
threshold_2 = Data(threshold)

# ---- group: 2D CP relaxation
mesh_stiffness_3 = Data(mesh_stiffness_2)
max_iterations_3 = Data(max_iterations_2)
anchor_points = Data(cullpt_2.Points)
threshold_3 = Data(threshold_2)
tolerance = Data(pts_merging_threshold_3)
mesh = Data(cdt_mesh_with_holes_2)
edgelengths = EdgeLengths(Mesh=mesh, LengthFactor=mesh_stiffness_3, Strength=1)
anchor = Anchor(Point=flatten(anchor_points), Strength=1000000)
show_2 = Show(G=mesh)
zombiesolver_2 = ZombieSolver(GoalObjects=[show_2, anchor, edgelengths], Threshold=threshold_3, Tolerance=tolerance, MaxIterations=max_iterations_3)  # -> I, V, O
mesh_2 = Mesh(zombiesolver_2.O)
clean_3 = CleanTree(RemoveNulls=True, RemoveInvalid=True, RemoveEmpty=False, Tree=mesh_2)
relaxed_mesh = Mesh(clean_3)

# ---- group: select relaxed or non relaxed meshes
relax_mesh_toggle_2 = Data(relax_mesh_toggle)
relaxed_cp_mesh = Data(relaxed_mesh)
p_n_c_2 = PickNChoose(Pattern=relax_mesh_toggle_2, Stream0=cdt_mesh_with_holes, Stream1=relaxed_cp_mesh)

# ---- group: weld and normalize mesh (safer but not necessary most times)
explode_16 = MeshExplode(Mesh=p_n_c_2, Interpolate=False)
mjoin = MeshJoin(Meshes=explode_16)
weld = WeldMesh(Mesh=mjoin, Angle=3.141592654)
weldvertices = MeshWeldVertices(Mesh=weld, Tolerance=0.01)  # -> RuntimeMessage, Mesh
unim = UnifyMesh(Mesh=weldvertices.Mesh)  # -> Result, Count
relaxed_cp_mesh_2 = Data(unim.Result)

# ---- group: flat creases segments
# SELECTION OF MESH EDGES WHICH ARE NOT
# ASSIGNED TO ANY CREASE
mountain_discrete_split_crvs_2 = Data(mountain_discrete_split_crvs)
valley_discrete_split_crvs_2 = Data(valley_discrete_split_crvs)
unassigned_discrete_split_crvs_2 = Data(unassigned_discrete_split_crvs)
relaxed_cp_mesh_3 = Data(relaxed_cp_mesh_2)
meshedges = ExtractMeshEdges(mesh=relaxed_cp_mesh_3)  # -> edges; inputs mesh: Mesh
# ---------- meshedges: Python ----------
import Rhino.Geometry as rg

def extract_mesh_edges(mesh):
    """
    Extracts the edges of a mesh as a list of Line objects.
    """
    edges = []
    for i in range(mesh.TopologyEdges.Count):
        edge = mesh.TopologyEdges.EdgeLine(i)
        edges.append(edge)
    return edges

# Example usage in Grasshopper Python component:
# Assume 'mesh' is the input mesh parameter
if mesh:
    mesh_edges = extract_mesh_edges(mesh)
    # Output the list of edges
    edges = mesh_edges
else:
    edges = []
# ---------- end meshedges ----------
medges_2 = MeshEdges(Mesh=relaxed_cp_mesh_3)  # -> NakedEdges, InteriorEdges, NonManifoldEdges
data_9 = Data([mountain_discrete_split_crvs_2, valley_discrete_split_crvs_2, unassigned_discrete_split_crvs_2])
curvepoint = PointOnCurve(medges_2.NakedEdges, parameter=0.5)
curvepoint_2 = PointOnCurve(meshedges, parameter=0.5)
curvepoint_3 = PointOnCurve(data_9, parameter=0.5)
curvepoint_4 = PointOnCurve(meshedges, parameter=0.5)
cps_2 = ClosestPoints(Point=flatten(curvepoint), Cloud=flatten(curvepoint_2), Count=1)  # -> ClosestPoint, CPIndex, Distance
cps_3 = ClosestPoints(Point=flatten(curvepoint_3), Cloud=flatten(curvepoint_4), Count=1)  # -> ClosestPoint, CPIndex, Distance
flatten_4 = FlattenTree(Tree=[cps_3.CPIndex, cps_2.CPIndex], Path="{0}")
cull_i_3 = CullIndex(List=flatten(meshedges), Indices=flatten(flatten_4), Wrap=True)
flat_discrete_split_crvs = Data(cull_i_3)

# ---- group: vertex and faces count
relaxed_cp_mesh_4 = Data(relaxed_cp_mesh_2)
demesh_2 = DeconstructMesh(Mesh=relaxed_cp_mesh_4)  # -> Vertices, Faces, Colours, Normals
lng_3 = ListLength(List=demesh_2.Vertices)
vertex_count = Panel(lng_3)
lng_4 = ListLength(List=demesh_2.Faces)
face_count = Panel(lng_4)

# ----
vertex_count_2 = Panel(vertex_count)
face_count_2 = Panel(face_count)

# ---- group: fold amount
valley_discrete_split_crvs_3 = Data(valley_discrete_split_crvs)
mountain_crvs_4 = Data(mountain_crvs_2)
mountain_discrete_split_crvs_3 = Data(mountain_discrete_split_crvs)
valley_crvs_4 = Data(valley_crvs_2)
content_cache = ContentCache(Content=valley_crvs_4)
content_cache_2 = ContentCache(Content=mountain_crvs_4)
retrieve_fold_amount = RetrieveFoldAmount(creases=content_cache)
retrieve_fold_amount_2 = RetrieveFoldAmount(creases=content_cache_2)
lng_5 = ListLength(List=valley_discrete_split_crvs_3)
dup = DuplicateData(Data=retrieve_fold_amount, Number=lng_5, Order=True)
lng_6 = ListLength(List=mountain_discrete_split_crvs_3)
dup_2 = DuplicateData(Data=retrieve_fold_amount_2, Number=lng_6, Order=True)
split_fold_amount_valley = Data(dup)
split_fold_amount_mountain = Data(dup_2)

# ---- group: extract creases' tips and ends
# EXTRAC
# HINGE TIPS
mountain_discrete_split_crvs_4 = Data(mountain_discrete_split_crvs)
unassigned_discrete_split_crvs_3 = Data(unassigned_discrete_split_crvs)
# FOLD AMOUNT
# FROM  ATTRIBUTE
flat_discrete_split_crvs_2 = Data(flat_discrete_split_crvs)
valley_discrete_split_crvs_4 = Data(valley_discrete_split_crvs)
relaxed_cp_mesh_5 = Data(relaxed_cp_mesh_2)
extract_hinge_points = ExtractHingePoints(list_of_creases_crv=mountain_discrete_split_crvs_4, triangulated_cp_mesh=relaxed_cp_mesh_5)  # -> tree, tree_2, tree_3, tree_4
extract_hinge_points_2 = ExtractHingePoints(list_of_creases_crv=valley_discrete_split_crvs_4, triangulated_cp_mesh=relaxed_cp_mesh_5)  # -> tree, tree_2, tree_3, tree_4
extract_hinge_points_3 = ExtractHingePoints(list_of_creases_crv=unassigned_discrete_split_crvs_3, triangulated_cp_mesh=relaxed_cp_mesh_5)  # -> tree, tree_2, tree_3, tree_4
extract_hinge_points_4 = ExtractHingePoints(list_of_creases_crv=flat_discrete_split_crvs_2, triangulated_cp_mesh=relaxed_cp_mesh_5)  # -> tree, tree_2, tree_3, tree_4
ln = Line(StartPoint=extract_hinge_points.tree, EndPoint=extract_hinge_points.tree_2)
mountain_discrete_split_crvs_5 = Data(ln)
ln_2 = Line(StartPoint=extract_hinge_points_2.tree, EndPoint=extract_hinge_points_2.tree_2)
valley_discrete_split_crvs_5 = Data(ln_2)
ln_3 = Line(StartPoint=extract_hinge_points_3.tree, EndPoint=extract_hinge_points_3.tree_2)
unassigned_discrete_split_crvs_4 = Data(ln_3)
ln_4 = Line(StartPoint=extract_hinge_points_4.tree, EndPoint=extract_hinge_points_4.tree_2)
flat_discrete_split_crvs_3 = Data(ln_4)

# ----
unassigned_discrete_split_crvs_5 = Data(unassigned_discrete_split_crvs_4)
boundary__discrete_split_crvs_5 = Data(boundary__discrete_split_crvs)
mountain_discrete_split_crvs_6 = Data(mountain_discrete_split_crvs_5)
valley_discrete_split_crvs_6 = Data(valley_discrete_split_crvs_5)
flat_discrete_split_crvs_4 = Data(flat_discrete_split_crvs_3)

# ---- group: calculate tolerance based on scale
relaxed_cp_mesh_6 = Data(relaxed_cp_mesh_2)
c_script_2 = CSharpScript(Msh=relaxed_cp_mesh_6)  # -> out, Pts; inputs Msh: Mesh
# ---------- c_script_2: C# ----------
   Pts = Msh.Vertices;
# ---------- end c_script_2 ----------
cps_4 = ClosestPoints(Point=graft(c_script_2.Pts), Cloud=c_script_2.Pts, Count=5)  # -> ClosestPoint, CPIndex, Distance
shift = ShiftList(List=cps_4.Distance, Shift=1, Wrap=False)  # -> flatten(List)
sort_3 = SortList(Keys=shift)  # -> Keys, ValuesA
division_4 = Division(A=sort_3.Keys, B=10)
item_2 = ListItem(List=division_4, Index=0, Wrap=True)

# ----
# KANGAROO SOLVER
relaxed_cp_mesh_7 = Data(relaxed_cp_mesh_2)

# ----
# ANCHOR PTS
move_anchor_points = Slider(1, range=0..1)
anchor_pts_strenght = Slider(1, range=0..1)
anchor_pts_delay = Slider(1, range=1..100)
anchor_pts_ease = Slider(1, range=1..100)
move_anchor_points_2 = Data(move_anchor_points)
anchor_pts_strenght_2 = Data(anchor_pts_strenght)
fold_strenght_6 = Data(anchor_pts_delay)
fold_strenght_7 = Data(anchor_pts_ease)

# ----
# GLUE
glue_strenght = Slider(1, range=0..1)
glue_delay = Slider(100, range=1..100)
glue_ease = Slider(100, range=1..100)
glue_strenght_2 = Data(glue_strenght)
fold_strenght_8 = Data(glue_delay)
fold_strenght_9 = Data(glue_ease)

# ----
# SLIDE
slide_strenght = Slider(1, range=0..1)
slide_delay = Slider(1, range=1..100)
slide_ease = Slider(1, range=1..100)
slide_strenght_2 = Data(slide_strenght)
fold_strenght_10 = Data(slide_delay)
fold_strenght_11 = Data(slide_ease)

# ----
# PLANAR CRVS
planar_strenght = Slider(1, range=0..1)
planar_delay = Slider(1, range=1..100)
planar_ease = Slider(1, range=1..100)
planar_strenght_2 = Data(planar_strenght)
fold_strenght_12 = Data(planar_delay)
fold_strenght_13 = Data(planar_ease)

# ----
# STRING SHRINKING
string_shrink_factor = Slider(0.747, range=0..1)
string_shrink_strenght = Slider(1, range=0..1)
string_shrink_delay = Slider(1, range=1..100)
string_shrink_factor_2 = Data(string_shrink_factor)
string_shrink_strenght_2 = Data(string_shrink_strenght)
fold_strenght_14 = Data(string_shrink_delay)

# ----
# COLLISIONS
collisions_radius = Slider(0.15, range=0..0.3)
collision_strenght = Slider(0, range=0..1)
collision_strenght_2 = Data(collision_strenght)
collisions_radius_2 = Data(collisions_radius)

# ----
# Collisions
average_pts_dist_4 = Data(average_pts_dist)
relaxed_cp_mesh_8 = Data(relaxed_cp_mesh_2)
collisions_radius_3 = Data(collisions_radius_2)
collision_strenght_3 = Data(collision_strenght_2)
graph = GraphMapper(collision_strenght_3, x0=0, x1=1, y0=0, y1=10000, container_name="Bezier", cpx=[0, 1, 1, 1], cpy=[0, 0, 0, 1])
demesh_3 = DeconstructMesh(Mesh=relaxed_cp_mesh_8)  # -> Vertices, Faces, Colours, Normals
multiplication = Multiplication(A=average_pts_dist_4, B=collisions_radius_3)
sc = SphereCollide(Points=demesh_3.Vertices, Radius=multiplication, Strength=graph)

panel = Panel(graph)

# ----
# FOLDING SIMULATION
# START / STOP SIMULATION
reset_simulation = Button()
start_stop_simulation = BooleanToggle(False)
improve_developability_use_at_the_end = BooleanToggle(False)
start_stop_simulation_2 = Data(start_stop_simulation)
reset_simulation_2 = Data(reset_simulation)
improve_developability = Data(improve_developability_use_at_the_end)

# ----
# Paper stretching stiffness
improve_developability_2 = Data(improve_developability)
stretching_stiffness_3 = Data(stretching_stiffness_2)
relaxed_cp_mesh_9 = Data(relaxed_cp_mesh_2)
turn_off_fold = TurnOffFold(value_to_maximize=stretching_stiffness_3, value="10000000", boolean=improve_developability_2)
edgelengths_2 = EdgeLengths(Mesh=relaxed_cp_mesh_9, LengthFactor=1, Strength=turn_off_fold)

# ----
# Paper bending stiffness
improve_developability_3 = Data(improve_developability)
fold_start_flat = Data(simplify(extract_hinge_points_4.tree))
fold_end_flat = Data(simplify(extract_hinge_points_4.tree_2))
tip_1_flat = Data(simplify(extract_hinge_points_4.tree_3))
tip_2_flat = Data(simplify(extract_hinge_points_4.tree_4))
bending_stiffness_2 = Data(bending_stiffness)
turn_off_fold_2 = TurnOffFold(value_to_maximize=bending_stiffness_2, value="1000", boolean=improve_developability_3)
hinge = Hinge(
    FoldStart=fold_start_flat,
    FoldEnd=fold_end_flat,
    Tip1=tip_1_flat,
    Tip2=tip_2_flat,
    RestAngle=0,
    Strength=turn_off_fold_2)

# ----
# Crvs bend stiffness
all_input_crvs_split_3 = Data(all_input_crvs_split)
crvs_bending_stiffness_3 = Data(crvs_bending_stiffness_2)
improve_developability_4 = Data(improve_developability)
clean_4 = CleanTree(RemoveNulls=True, RemoveInvalid=True, RemoveEmpty=True, Tree=all_input_crvs_split_3)
turn_off_fold_3 = TurnOffFold(value_to_maximize=crvs_bending_stiffness_3, value="1000", boolean=improve_developability_4)
join_2 = JoinCurves(Curves=clean_4, Preserve=False)
rod = Rod(Polyline=join_2, LengthFactor=1, AngleFactor=1, AxialStrength=10, BendStrength=turn_off_fold_3)

# ---- group: start timer
# time
# counter
start_stop_simulation_3 = Data(start_stop_simulation_2)
reset_simulation_3 = Data(reset_simulation_2)
step = Panel("4")
ms_2 = Panel("20")

# ---- group: delay varible
delay = Data(fold_strenght_2)
value = Data(fold_strenght_4)
addition = Addition(A=fold_strenght_2, B=fold_strenght_3)
time_limit = Data(addition)
total_delay_ramp_time = Panel(addition)

delay_2 = Data(fold_strenght_6)
value_2 = Data(anchor_pts_strenght_2)
addition_2 = Addition(A=fold_strenght_6, B=fold_strenght_7)
time_limit_2 = Data(addition_2)
total_delay_ramp_time_2 = Panel(addition_2)

delay_3 = Data(fold_strenght_8)
value_3 = Data(glue_strenght_2)
addition_3 = Addition(A=fold_strenght_8, B=fold_strenght_9)
time_limit_3 = Data(addition_3)
total_delay_ramp_time_3 = Panel(addition_3)

delay_4 = Data(fold_strenght_10)
value_4 = Data(slide_strenght_2)
addition_4 = Addition(A=fold_strenght_10, B=fold_strenght_11)
time_limit_4 = Data(addition_4)
total_delay_ramp_time_4 = Panel(addition_4)

delay_5 = Data(fold_strenght_12)
value_5 = Data(planar_strenght_2)
addition_5 = Addition(A=fold_strenght_12, B=fold_strenght_13)
time_limit_5 = Data(addition_5)
total_delay_ramp_time_5 = Panel(addition_5)

# ---- group: delay varible starts from 1
delay_6 = Data(fold_strenght_14)
value_6 = Data(string_shrink_factor_2)
addition_6 = Addition(A=fold_strenght_14, B=fold_strenght_5)
time_limit_6 = Data(addition_6)
total_delay_ramp_time_6 = Panel(addition_6)

# ---- group: maximum time needed delay+ramp
bounds = Bounds(Numbers=[total_delay_ramp_time, total_delay_ramp_time_2, total_delay_ramp_time_3, total_delay_ramp_time_4, total_delay_ramp_time_5, total_delay_ramp_time_6])
deconstruct_domain = DeconstructDomain(Domain=bounds)  # -> Start, End

# ----
max_time_limit = Panel(deconstruct_domain.End)

# ---- group: start timer (continued)
timer = Python3Script(reset=reset_simulation_3, enable=start_stop_simulation_3, step=step, limit=max_time_limit, delay_ms=ms_2)  # -> a; inputs reset: Boolean, enable: Boolean, step: Int32, limit: Int32, delay_ms: Int32
# ---------- timer: Python ----------
import scriptcontext as sc

ghdoc = ghenv.Component.OnPingDocument()

# init sticky
sc.sticky.setdefault("counter", 0)

# safe limit
try:
    _limit = limit
except NameError:
    _limit = None

# reset
if reset:
    sc.sticky["counter"] = 0

def _tick(doc):
    # Siamo nel callback: facciamo solo expiring; la soluzione è già schedulata
    ghenv.Component.ExpireSolution(False)  # meglio False nel callback [web:52]

# condizione di "running"
under_limit = (_limit is None) or (sc.sticky["counter"] < _limit)
running = bool(enable) and under_limit

if running:
    # step
    sc.sticky["counter"] += step

    # clamp
    if _limit is not None and sc.sticky["counter"] > _limit:
        sc.sticky["counter"] = _limit

    # schedule NEXT tick (solo se dobbiamo continuare)
    ghdoc.ScheduleSolution(delay_ms, _tick)  # ms [web:21][web:26]

a = sc.sticky["counter"]
# ---------- end timer ----------
# OUTPUTS COLOR/VISIBILITY
# AND TO BAKE
time = Data(timer)

# ---- group: delay varible (continued)
time_2 = Data(time)
total_time = Data(deconstruct_domain.End)
cluster_9 = Cluster_3(time=time_2, delay=delay, value=value, total_time=total_time, time_limit=time_limit)

time_3 = Data(time)
total_time_2 = Data(deconstruct_domain.End)
cluster_10 = Cluster_3(time=time_3, delay=delay_2, value=value_2, total_time=total_time_2, time_limit=time_limit_2)

time_4 = Data(time)
total_time_3 = Data(deconstruct_domain.End)
cluster_11 = Cluster_3(time=time_4, delay=delay_3, value=value_3, total_time=total_time_3, time_limit=time_limit_3)

time_5 = Data(time)
total_time_4 = Data(deconstruct_domain.End)
cluster_12 = Cluster_3(time=time_5, delay=delay_4, value=value_4, total_time=total_time_4, time_limit=time_limit_4)

time_6 = Data(time)
total_time_5 = Data(deconstruct_domain.End)
cluster_13 = Cluster_3(time=time_6, delay=delay_5, value=value_5, total_time=total_time_5, time_limit=time_limit_5)

# ---- group: delay varible starts from 1 (continued)
time_7 = Data(time)
total_time_6 = Data(deconstruct_domain.End)
cluster_14 = Cluster_4(time=time_7, delay=delay_6, value=value_6, total_time=total_time_6, time_limit=time_limit_6)

# ----
# Planar Crvs
planar_crvs_discrete_pts_2 = Data(planar_crvs_discrete_pts)
planar_strenght_3 = Data(cluster_13)
graph_2 = GraphMapper(planar_strenght_3, x0=0, x1=1, y0=0, y1=10000, container_name="Bezier", cpx=[0, 1, 1, 1], cpy=[0, 0, 0, 1])
coplanar = CoPlanar(Points=planar_crvs_discrete_pts_2, Strength=graph_2)

panel_2 = Panel(graph_2)

# ----
# KANGAROO GOAL
# CONSTRAINS
# Mountain
# creases
# Valley
# creases
fold_start_mount = Data(simplify(extract_hinge_points.tree))
fold_end_mount = Data(simplify(extract_hinge_points.tree_2))
tip_1_mount = Data(simplify(extract_hinge_points.tree_3))
tip_2_mount = Data(simplify(extract_hinge_points.tree_4))
fold_amount_3 = Data(fold_amount_2)
split_fold_amount_mountain_2 = Data(split_fold_amount_mountain)
split_fold_amount_valley_2 = Data(split_fold_amount_valley)
fold_start_mount_2 = Data(simplify(extract_hinge_points_2.tree))
fold_end_mount_2 = Data(simplify(extract_hinge_points_2.tree_2))
tip_1_mount_2 = Data(simplify(extract_hinge_points_2.tree_3))
tip_2_mount_2 = Data(simplify(extract_hinge_points_2.tree_4))
fold_strenght_15 = Data(cluster_9)
multiplication_2 = Multiplication(A=fold_amount_3, B=split_fold_amount_mountain_2)
multiplication_3 = Multiplication(A=fold_amount_3, B=split_fold_amount_valley_2)
pi = Pi(Factor=multiplication_3)
pi_2 = Pi(Factor=expr("-x", multiplication_2))  # -> simplify(Output)
c_custom_hinge = CSharpScript(
    FoldStart=simplify(fold_start_mount),
    FoldEnd=simplify(fold_end_mount),
    Tip1=simplify(tip_1_mount),
    Tip2=simplify(tip_2_mount),
    RestAngle=pi_2,
    Strength=fold_strenght_15)  # -> out, a; inputs FoldStart: Point3d, FoldEnd: Point3d, Tip1: Point3d, Tip2: Point3d, RestAngle: Double, Strength: Double
# ---------- c_custom_hinge: C# ----------
// Grasshopper Script Instance
#region Usings
using System;
using System.Linq;
using System.Collections;
using System.Collections.Generic;
using System.Drawing;

using Rhino;
using Rhino.Geometry;

using Grasshopper;
using Grasshopper.Kernel;
using Grasshopper.Kernel.Data;
using Grasshopper.Kernel.Types;
#r "KangarooSolver.dll"
using KangarooSolver;
#endregion


public class Script_Instance : GH_ScriptInstance
{
    #region Notes
    /* 
      Members:
        RhinoDoc RhinoDocument
        GH_Document GrasshopperDocument
        IGH_Component Component
        int Iteration

      Methods (Virtual & overridable):
        Print(string text)
        Print(string format, params object[] args)
        Reflect(object obj)
        Reflect(object obj, string method_name)
    */
    #endregion

    private void RunScript(
		Point3d FoldStart,
		Point3d FoldEnd,
		Point3d Tip1,
		Point3d Tip2,
		double RestAngle,
		double Strength,
		ref object a)
    {        
        a = new HingeA(FoldStart, FoldEnd, Tip1, Tip2, RestAngle, Strength);
    }

      public class HingeA : GoalObject
  {
    public double Strength;
    public double RestAngle;

    public HingeA(Point3d P0, Point3d P1, Point3d P2, Point3d P3, double RA, double k)
    {
      PPos = new Point3d[4] { P0, P1, P2, P3 };
      Move = new Vector3d[4];
      Weighting = new double[4];
      Strength = k;
      RestAngle = RA;
    }

    public override void Calculate(List<KangarooSolver.Particle> p)
    {
      Point3d P0 = p[PIndex[0]].Position;
      Point3d P1 = p[PIndex[1]].Position;
      Point3d P2 = p[PIndex[2]].Position;
      Point3d P3 = p[PIndex[3]].Position;

      Vector3d V01 = P1 - P0;
      Vector3d V02 = P2 - P0;
      Vector3d V03 = P3 - P0;
      Vector3d V21 = P1 - P2;
      Vector3d V31 = P1 - P3;

      double L01 = V01.Length;
      double invL01 = 1.0 / L01;

      double H0 = (V02 - V02 * invL01 * invL01 * V01 * V01).Length;
      double H1 = (V03 - V03 * invL01 * invL01 * V01 * V01).Length;
      double H = 0.5 / (H0 + H1);

      double Dot0201 = V02 * V01;
      double Dot0301 = V03 * V01;
      double Dot2101 = V21 * V01;
      double Dot3101 = V31 * V01;

      Vector3d Cross0 = Vector3d.CrossProduct(V02, V01);
      Vector3d Cross1 = Vector3d.CrossProduct(V01, V03);

      double CurrentAngle = Vector3d.VectorAngle(Cross0, Cross1, new Plane(P0, V01));
      if (CurrentAngle > Math.PI) { CurrentAngle = CurrentAngle - 2 * Math.PI; }
      double AngleError = CurrentAngle - RestAngle;
      if(AngleError > Math.PI)
      {
        AngleError -= 2 * Math.PI;
      }
      if(AngleError < -Math.PI)
      {
        AngleError += 2 * Math.PI;
      }
      double InvL = 1.0 / Cross0.Length;
      double Cot0u = Dot0201 * InvL;
      double Cot0v = Dot2101 * InvL;
      InvL = 1.0 / Cross1.Length;
      double Cot1u = Dot0301 * InvL;
      double Cot1v = Dot3101 * InvL;

      double D = AngleError * H * 0.5;
      Vector3d A = Cross0 * D;
      Move[0] = Cot0v * A;
      Move[1] = Cot0u * A;
      Move[2] = -(Cot0v + Cot0u) * A;
      A = Cross1 * D;
      Move[0] += Cot1v * A;
      Move[1] += Cot1u * A;
      Move[3] = -(Cot1v + Cot1u) * A;

      Weighting[0] = Strength;
      Weighting[1] = Strength;
      Weighting[2] = Strength;
      Weighting[3] = Strength;
    }

  }
}
# ---------- end c_custom_hinge ----------
c_custom_hinge_2 = CSharpScript(
    FoldStart=fold_start_mount_2,
    FoldEnd=fold_end_mount_2,
    Tip1=tip_1_mount_2,
    Tip2=tip_2_mount_2,
    RestAngle=pi,
    Strength=fold_strenght_15)  # -> out, a; inputs FoldStart: Point3d, FoldEnd: Point3d, Tip1: Point3d, Tip2: Point3d, RestAngle: Double, Strength: Double; same code as c_custom_hinge

# ----
# Glue
pts_to_glue_input_4 = Data(pts_to_glue_input_2)
pts_to_glue_target_4 = Data(pts_to_glue_target_2)
crvs_to_glue_input__discrete_pts_2 = Data(crvs_to_glue_input__discrete_pts)
crvs_to_glue_target__discrete_pts_2 = Data(crvs_to_glue_target__discrete_pts)
glue_strenght_3 = Data(cluster_11)
path_mapper_9 = PathMapper(crvs_to_glue_input__discrete_pts_2, source="{A;B}", target="{0;B}")
path_mapper_10 = PathMapper(crvs_to_glue_target__discrete_pts_2, source="{A;B}", target="{0;B}")
graph_3 = GraphMapper(glue_strenght_3, x0=0, x1=1, y0=0, y1=1, container_name="Bezier", cpx=[0, 0, 1, 1], cpy=[0, 0, 0, 1])
merge_11 = Merge(Data1=graft([pts_to_glue_input_4, path_mapper_9]), Data2=graft([pts_to_glue_target_4, path_mapper_10]))
graph_4 = GraphMapper(graph_3, x0=0, x1=1, y0=0, y1=10000, container_name="Bezier", cpx=[0, 1, 1, 1], cpy=[0, 0, 0, 1])
ms_3 = MagnetSnap(Points=merge_11, Range=1e+29, Strength=graph_4)

panel_3 = Panel(graph_4)

# ----
# Slide Pts to Crv
anchor_crv_target = Data(sliding_crv_target)
pts_sliding_on_crv_input_5 = Data(pts_sliding_on_crv_input_2)
slide_strenght_3 = Data(cluster_12)
graph_5 = GraphMapper(slide_strenght_3, x0=0, x1=1, y0=0, y1=10000, container_name="Bezier", cpx=[0, 1, 1, 1], cpy=[0, 0, 0, 1])
oncurve = OnCurve(Points=graft(pts_sliding_on_crv_input_5), Curve=graft(anchor_crv_target), Strength=graph_5)

# ----
# Slide Pts to Srf
pts_sliding_on_srf_input_5 = Data(pts_sliding_on_srf_input_2)
crvs_sliding_on_target_srf_input__discre_3 = Data(crvs_sliding_on_target_srf_input__discre_2)  # "Crvs sliding on target Srf (input) _discrete (Pts)"
sliding_srf_target_3 = Data(sliding_srf_target_2)
slide_strenght_4 = Data(cluster_12)
graph_6 = GraphMapper(slide_strenght_4, x0=0, x1=1, y0=0, y1=10000, container_name="Bezier", cpx=[0, 1, 1, 1], cpy=[0, 0, 0, 1])
mesh_3 = MeshBrep(
    Brep=sliding_srf_target_3,
    Settings={GridMaxCount=0, GridMinCount=16, JaggedSeams=False, MaxEdgeLength=0, MinEdgeLength=0.0001, MinTolerance=0, Refine=True, RefineAngle=0, RelativeTolerance=0.65, SimplePlanes=True, Tolerance=0})
onmesh = OnMesh(Points=flatten([pts_sliding_on_srf_input_5, crvs_sliding_on_target_srf_input__discre_3]), Mesh=mesh_3, Strength=graph_6)

panel_4 = Panel(graph_6)

# ----
# String
strings_list_of_straignt_segments = Data(strings)
string_shrink_factor_3 = Data(cluster_14)
string_shrink_strenght_3 = Data(string_shrink_strenght_2)
divide_2 = DivideCurve(Curve=strings_list_of_straignt_segments, Count=7, Kinks=False)  # -> Points, Tangents, Parameters
graph_7 = GraphMapper(string_shrink_strenght_3, x0=0, x1=1, y0=0, y1=1, container_name="Bezier", cpx=[0, 0, 1, 1], cpy=[0, 0, 0, 1])
shatter = Shatter(Curve=strings_list_of_straignt_segments, Parameters=divide_2.Parameters)
graph_8 = GraphMapper(graph_7, x0=0, x1=1, y0=0, y1=10000, container_name="Bezier", cpx=[0, 1, 1, 1], cpy=[0, 0, 0, 1])
len_3 = Length(Curve=shatter)
multiplication_4 = Multiplication(A=len_3, B=string_shrink_factor_3)
length_line = LengthLine(Line=shatter, Length=multiplication_4, Strength=graph_8)

panel_5 = Panel(graph_8)

strings_list_of_straignt_segments_2 = Data(shatter)
sliding_srf_target_4 = Data(mesh_3)
glue_points = Data(merge_11)

timer_count_limit = Panel(timer)

# ----
# OUTPUT MESH
# (PREVIEW)
# STRETCH COLOUR
unfolded_original_mesh = Data(relaxed_cp_mesh)
stretch_domain_mmq = Slider(0.01, range=0.01..100)
material_2 = Material()
preview = CustomPreview(Geometry=unfolded_original_mesh, Material=ColourSwatch(SwatchColor=RGB(156, 156, 156)))

# ----
# CONSTRAINS
# (BAKE PREVIEW)
swatch = ColourSwatch(SwatchColor=RGB(0, 149, 255))

# ----
# OUTPUT MESH
# COMPONENTS
# (PREVIEW)
swatch_2 = ColourSwatch(SwatchColor=RGB(255, 0, 0))

# ----
# VISUALIZE APPROX
# RULING (ONLY FOR DENSE
# CURVED FOLDED MODELS)
# (Attach the data node to
# the data dam node and
# clik play to estimate ruling
# for denser approx ruling
# increase mesh density)
erase_princ_curv_lines_close_to_sharp_ed = Slider(8, range=1..20)  # "Erase Princ Curv Lines Close to Sharp Edges"
dam = DataDam(BufferDelay=20000000, BufferMode=0)

# ----
# INPUT
erase_curvature_lines_distance_multiplie = Data(erase_princ_curv_lines_close_to_sharp_ed)  # "Erase curvature lines distance multiplier"
# EXTRACT MINIMAL PRINCIPAL CURVATURE LINES
_3d_folded_mesh = Mesh(dam)

_3d_folded_mesh_2 = Mesh(_3d_folded_mesh)

# ---- group: find unwelded edges
c__findunweld = CSharpScript(Msh=_3d_folded_mesh_2)  # -> out, A; inputs Msh: Mesh
# ---------- c__findunweld: C# ----------
    Rhino.Geometry.Collections.MeshTopologyEdgeList MTE = Msh.TopologyEdges;

    List<Line> edges = new List<Line>();
    int hui = Msh.TopologyEdges.Count;

    for(int i = 0;i < hui;i++)
    {
      if(MTE.IsEdgeUnwelded(i))
      {
        Line edge = MTE.EdgeLine(i);
        edges.Add(edge);
      }
    }
    A = edges;
# ---------- end c__findunweld ----------
_3d_creases = Curve(c__findunweld.A)

# ----
explode_17 = MeshExplode(Mesh=_3d_folded_mesh, Interpolate=False)
area_2 = MeshArea(Mesh=graft(explode_17))  # -> Area, Centroid
one_point_per_face = Data(area_2.Centroid)
each_face_area = Data(area_2.Area)

# ---- group: CREASES AND BOUNDARIES
medges_3 = MeshEdges(Mesh=_3d_folded_mesh_2)  # -> NakedEdges, InteriorEdges, NonManifoldEdges
join_3 = JoinCurves(Curves=_3d_creases, Preserve=False)
join_4 = JoinCurves(Curves=medges_3.NakedEdges, Preserve=False)
merge_12 = Merge(Data1=join_4, Data2=join_3)

# ---- group: ERASE FURTHER POINTS ACCORDING TO DISTANCE
crv_cp_2 = CurveClosestPoint(Point=one_point_per_face, Curve=flatten(merge_12))  # -> Point, Parameter, Distance
bnd_2 = Bounds(Numbers=crv_cp_2.Distance)
dedomain_2 = DeconstructDomain(Domain=bnd_2)  # -> Start, End

# ---- group: multiply min point distance
flatten_5 = FlattenTree(Tree=dedomain_2.Start, Path="{0}")
bnd_3 = Bounds(Numbers=flatten_5)
dedomain_3 = DeconstructDomain(Domain=bnd_3)  # -> Start, End
multiplication_5 = Multiplication(A=dedomain_3.Start, B=erase_curvature_lines_distance_multiplie)

# ---- group: ERASE FURTHER POINTS ACCORDING TO DISTANCE (continued)
larger_3 = LargerThan(FirstNumber=dedomain_2.Start, SecondNumber=multiplication_5)  # -> LargerThan, OrEqualTo
cull_6 = CullPattern(List=each_face_area, CullPattern=larger_3.LargerThan)
cull_7 = CullPattern(List=one_point_per_face, CullPattern=larger_3.LargerThan)
clean_5 = CleanTree(RemoveNulls=True, RemoveInvalid=True, RemoveEmpty=True, Tree=cull_6)
clean_6 = CleanTree(RemoveNulls=True, RemoveInvalid=True, RemoveEmpty=True, Tree=cull_7)

# ---- group: define planes
_3d_folded_mesh_3 = Mesh(_3d_folded_mesh)
meshcp = MeshClosestPoint(Point=clean_6, Mesh=_3d_folded_mesh_3)  # -> Point, Index, Parameter
meval = MeshEval(Mesh=_3d_folded_mesh_3, Parameter=meshcp.Parameter)  # -> Point, Normal, Colour
pl = PlaneNormal(Origin=meval.Point, ZAxis=meval.Normal)

# ---- group: define circles
each_face_area_2 = Data(clean_5)
expression = Expression(x=each_face_area_2, Expression="Sqrt(x/Pi)")
multiplication_6 = Multiplication(A=expression, B="2.5")
cir = Circle(Plane=pl, Radius=multiplication_6)

# ---- group: cleaning up circles with more or less than 4 intersecitons
_3d_folded_mesh_4 = Mesh(_3d_folded_mesh)
divide_3 = DivideCurve(Curve=cir, Count=6, Kinks=False)  # -> Points, Tangents, Parameters
pull_2 = PullPoint(Point=divide_3.Points, Geometry=_3d_folded_mesh_4, ClosestOnly=True)  # -> ClosestPoint, Distance, Index
fcircle = CircleFit(Points=pull_2.ClosestPoint)  # -> Circle, Radius, Deviation
mcx = MeshCurve(Mesh=_3d_folded_mesh_4, Curve=fcircle.Circle)  # -> Points, Faces
lng_7 = ListLength(List=mcx.Points)
viewer = ParamViewer(mcx.Points)
equals = Equality(FirstNumber=lng_7, SecondNumber="4")  # -> Equality, Inequality
cull_8 = CullPattern(List=viewer, CullPattern=flatten(equals.Equality))
cull_9 = CullPattern(List=viewer, CullPattern=flatten(equals.Equality))
graft = GraftTree(Tree=fcircle.Circle, IncludeEmptyLists=True, IncludeNullItems=True)
branch_9 = TreeBranch(Tree=mcx.Points, Path=cull_8, MaintainPaths=True)
branch_10 = TreeBranch(Tree=graft, Path=cull_9, MaintainPaths=True)

# ---- group: reproject points on mesh
_3d_folded_mesh_5 = Mesh(_3d_folded_mesh)
area_3 = Area(Geometry=branch_10)  # -> Area, graft(Centroid)
pull_3 = PullPoint(Point=area_3.Centroid, Geometry=_3d_folded_mesh_5, ClosestOnly=True)  # -> ClosestPoint, Distance, Index

# ---- group: drawing approximation of dupin indicatrix
item_3 = ListItem(List=branch_9, Index=0, Wrap=True)  # -> Item, Item1, Item2, Item3
vec2pt = Vector2Pt(PointA=item_3.Item3, PointB=item_3.Item1, Unitize=True)  # -> Vector, Length
vec2pt_2 = Vector2Pt(PointA=item_3.Item, PointB=item_3.Item2, Unitize=True)  # -> Vector, Length
vec2pt_3 = Vector2Pt(PointA=item_3.Item3, PointB=item_3.Item1, Unitize=True)  # -> Vector, Length
vec2pt_4 = Vector2Pt(PointA=item_3.Item2, PointB=item_3.Item, Unitize=True)  # -> Vector, Length

# ---- group: draw the length of ruling
addition_7 = Addition(A=vec2pt_3.Vector, B=vec2pt_4.Vector)
addition_8 = Addition(A=vec2pt.Vector, B=vec2pt_2.Vector)
rev = Reverse(Vector=addition_8)
line = LineSDL(Start=graft(pull_3.ClosestPoint), Direction=rev, Length=multiplication_6)
line_2 = LineSDL(Start=graft(pull_3.ClosestPoint), Direction=addition_8, Length=multiplication_6)
rev_2 = Reverse(Vector=addition_7)
line_3 = LineSDL(Start=graft(pull_3.ClosestPoint), Direction=rev_2, Length=multiplication_6)
line_4 = LineSDL(Start=graft(pull_3.ClosestPoint), Direction=addition_7, Length=multiplication_6)

# ---- group: calculating distance from surface
_3d_folded_mesh_6 = Mesh(_3d_folded_mesh)
_3d_folded_mesh_7 = Mesh(_3d_folded_mesh)
merge_13 = Merge(Data1=line, Data2=line_2)
end_3 = EndPoints(Curve=merge_13)  # -> Start, End
pull_4 = PullPoint(Point=end_3.End, Geometry=_3d_folded_mesh_6, ClosestOnly=True)  # -> ClosestPoint, Distance, Index
abs = Absolute(Value=pull_4.Distance)
merge_14 = Merge(Data1=line_3, Data2=line_4)
end_4 = EndPoints(Curve=merge_14)  # -> Start, End
pull_5 = PullPoint(Point=end_4.End, Geometry=_3d_folded_mesh_7, ClosestOnly=True)  # -> ClosestPoint, Distance, Index
abs_2 = Absolute(Value=pull_5.Distance)
sort_4 = SortList(Keys=abs)  # -> Keys, ValuesA
item_4 = ListItem(List=sort_4.Keys, Index=0, Wrap=True)  # -> Item, Item1
multiplication_7 = Multiplication(A=item_4.Item, B=item_4.Item1)
sort_5 = SortList(Keys=abs_2)  # -> Keys, ValuesA
item_5 = ListItem(List=sort_5.Keys, Index=0, Wrap=True)  # -> Item, Item1
multiplication_8 = Multiplication(A=item_5.Item, B=item_5.Item1)

# ---- group: find major and minor principal curvature directions
data_10 = Data(multiplication_7)
data_11 = Data(multiplication_8)
larger_4 = LargerThan(FirstNumber=data_10, SecondNumber=data_11)  # -> LargerThan, OrEqualTo
cull_10 = CullPattern(List=merge_13, CullPattern=invert(larger_4.LargerThan))
cull_11 = CullPattern(List=merge_14, CullPattern=invert(larger_4.LargerThan))
cull_12 = CullPattern(List=merge_13, CullPattern=larger_4.LargerThan)
cull_13 = CullPattern(List=merge_14, CullPattern=larger_4.LargerThan)
merge_15 = Merge(Data1=cull_10, Data2=cull_13)
merge_16 = Merge(Data1=cull_12, Data2=cull_11)
max_curvature_direction = Curve(merge_16)
min_curvature_direction = Curve(merge_15)

# ----
# MAP CURVATEURE LINES ON PLANE
relaxed_cp_mesh_10 = Data(relaxed_cp_mesh_2)
_3d_folded_mesh_8 = Mesh(_3d_folded_mesh)
minimal_curvature_lines = Data(min_curvature_direction)
end_5 = EndPoints(Curve=minimal_curvature_lines)  # -> Start, End
meshcp_2 = MeshClosestPoint(Point=end_5.End, Mesh=_3d_folded_mesh_8)  # -> Point, Index, Parameter
meshcp_3 = MeshClosestPoint(Point=end_5.Start, Mesh=_3d_folded_mesh_8)  # -> Point, Index, Parameter
meshmap = MeshMap(SourceMesh=_3d_folded_mesh_8, TargetMesh=relaxed_cp_mesh_10, Point=meshcp_2.Point, Distance=1)
meshmap_2 = MeshMap(SourceMesh=_3d_folded_mesh_8, TargetMesh=relaxed_cp_mesh_10, Point=meshcp_3.Point, Distance=1)
ln_5 = Line(StartPoint=meshmap_2, EndPoint=meshmap)

# ----
# LINES OF MAXIMUM AND
# MINIMUME CURVATURE
# COLOURED PREVIEW
min_curvature_direction_on_plane = Data(ln_5)
max_curvature_direction_2 = Curve(max_curvature_direction)
min_curvature_direction_2 = Curve(min_curvature_direction)
preview_2 = CustomPreview(Geometry=max_curvature_direction_2, Shader=ColourSwatch(SwatchColor=RGB(255, 0, 0)))
preview_3 = CustomPreview(Geometry=min_curvature_direction_on_plane, Shader=ColourSwatch(SwatchColor=RGB(166, 255, 0)))
preview_4 = CustomPreview(Geometry=min_curvature_direction_2, Shader=ColourSwatch(SwatchColor=RGB(21, 0, 255)))

actual_erasing_distance = Panel(multiplication_5)

# ----
# Anchor points
move_anchor_points_3 = Data(move_anchor_points_2)
anchor_pts_target_3 = Data(anchor_pts_target_2)
anchor_pts_strenght_3 = Data(cluster_10)
anchor_pts_input_4 = Data(anchor_pts_input_2)
graph_9 = GraphMapper(anchor_pts_strenght_3, x0=0, x1=1, y0=0, y1=10000, container_name="Bezier", cpx=[0, 1, 1, 1], cpy=[0, 0, 0, 1])

panel_6 = Panel(graph_9)

# ----
# Move anchor
ln_6 = Line(StartPoint=anchor_pts_input_4, EndPoint=anchor_pts_target_3)
eval = EvaluateCurve(Curve=reparameterize(ln_6), Parameter=move_anchor_points_3)  # -> Point, Tangent, Angle
anchor_points_2 = Data(eval.Point)

anchor_2 = Anchor(Point=anchor_pts_input_4, Target=anchor_points_2, Strength=graph_9)

merge_17 = Merge(
    Data1=grab,
    Data2=sc,
    Data3=edgelengths_2,
    Data4=hinge,
    Data5=c_custom_hinge.a,
    Data6=c_custom_hinge_2.a,
    Data8=ms_3,
    Data9=anchor_2,
    Data10=onmesh,
    Data11=oncurve,
    Data12=length_line,
    Data13=coplanar,
    Data14=rod)  # -> flatten(Result)
input_anchor_points = Data(anchor_pts_input_4)

# ----
# sort
cluster_15 = Cluster(relay=relaxed_cp_mesh_7)
cluster_16 = Cluster(relay=mountain_discrete_split_crvs_6)
cluster_17 = Cluster(relay=input_anchor_points)
cluster_18 = Cluster(relay=unassigned_discrete_split_crvs_5)
cluster_19 = Cluster(relay=boundary__discrete_split_crvs_5)
cluster_20 = Cluster(relay=valley_discrete_split_crvs_6)
cluster_21 = Cluster(relay=flat_discrete_split_crvs_4)
cluster_22 = Cluster(relay=glue_points)
cluster_23 = Cluster(relay=pts_sliding_on_srf_input_4)
cluster_24 = Cluster(relay=pts_sliding_on_crv_input_4)
cluster_25 = Cluster(relay=sliding_crv_target_2)
cluster_26 = Cluster(relay=sliding_srf_target_4)
cluster_27 = Cluster(relay=strings_list_of_straignt_segments_2)
all_goal_constraints = Data(merge_17)
show_3 = Show(G=cluster_15)
show_4 = Show(G=cluster_16)
show_5 = Show(G=cluster_19)
show_6 = Show(G=cluster_21)
show_7 = Show(G=cluster_22)
show_8 = Show(G=cluster_23)
show_9 = Show(G=cluster_17)
show_10 = Show(G=cluster_24)
show_11 = Show(G=cluster_25)
show_12 = Show(G=cluster_26)
show_13 = Show(G=cluster_18)
show_14 = Show(G=cluster_20)
show_15 = Show(G=cluster_27)
entwine = Entwine(
    Branch00=show_3,
    Branch01=show_4,
    Branch02=show_14,
    Branch03=show_13,
    Branch04=show_5,
    Branch05=show_6,
    Branch06=show_7,
    Branch07=show_8,
    Branch08=show_9,
    Branch09=show_10,
    Branch010=show_11,
    Branch011=show_12,
    Branch012=show_15,
    Branch013=all_goal_constraints,
    FlattenInputs=True)

# ----
# kangaroo
# solver
start_stop_simulation_4 = Data(start_stop_simulation_2)
reset_simulation_4 = Data(reset_simulation_2)
clean_7 = CleanTree(RemoveNulls=True, RemoveInvalid=True, RemoveEmpty=True, Tree=entwine)
solver = Solver(GoalObjects=clean_7, Reset=reset_simulation_4, Threshold=1e-15, Tolerance=item_2, On=start_stop_simulation_4)  # -> I, V, O

bang = ExplodeTree(Data=solver.O)  # -> Branch0, Branch1, Branch2, Branch3, Branch4, Branch5, Branch6, Branch7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
valley_creases_kangaroo = Data(bang.Branch2)
folded_mesh_kangaroo = Mesh(bang.Branch0)
boundaries_kangaroo = Curve(bang.Branch4)
flat_creases_kangaroo = Data(bang.Branch5)
glue_points_kangaroo = Data(bang.Branch6)
all_mesh_edges_kangaroo = Data(bang.Branch13)
mountain_creases_kangaroo = Data(bang.Branch1)
input_points_on_srf_kangaroo = Data(bang.Branch7)
target_sliding_curve_kangaroo = Data(bang.Branch10)
target_sliding_surface_kangaroo = Data(bang.Branch11)
unassigned_creases_kangaroo = Data(bang.Branch3)
input_anchor_points_kangaroo = Data(bang.Branch8)
input_points_on_curve_kangaroo = Data(bang.Branch9)

strings_list_of_straignt_segments_3 = Data(bang.Branch12)

input_anchor_points_2 = Data(input_anchor_points_kangaroo)
input_points_on_curve = Data(input_points_on_curve_kangaroo)
target_sliding_curve = Data(target_sliding_curve_kangaroo)
target_sliding_surface = Data(target_sliding_surface_kangaroo)
glue_points_2 = Data(glue_points_kangaroo)
target_anchor_points = Data(anchor_points_2)
input_points_on_srf = Data(input_points_on_srf_kangaroo)
string = Data(strings_list_of_straignt_segments_3)
preview_5 = CustomPreview(Geometry=glue_points_2, Material=swatch)
preview_6 = CustomPreview(Geometry=input_anchor_points_2, Material=ColourSwatch(SwatchColor=RGB(255, 0, 0)))
preview_7 = CustomPreview(Geometry=target_anchor_points, Material=ColourSwatch(SwatchColor=RGB(153, 0, 0)))
preview_8 = CustomPreview(Geometry=input_points_on_curve, Material=ColourSwatch(SwatchColor=RGB(255, 133, 233)))
preview_9 = CustomPreview(Geometry=target_sliding_curve, Material=ColourSwatch(SwatchColor=RGB(255, 133, 233)))
preview_10 = CustomPreview(Geometry=input_points_on_srf, Material=ColourSwatch(SwatchColor=RGB(60, 255, 0)))
preview_11 = CustomPreview(Geometry=target_sliding_surface, Material=material)
preview_12 = CustomPreview(Geometry=string, Material=ColourSwatch(SwatchColor=RGB(60, 255, 0)))

# ----
# ERROR
# EVALUATION
# AREA ERROR EVALUATION
relaxed_cp_mesh_11 = Data(relaxed_cp_mesh_2)
folded_mesh_kangaroo_2 = Mesh(folded_mesh_kangaroo)
error_evaluation = ErrorEvaluation(geometry=relaxed_cp_mesh_11, geometry_2=folded_mesh_kangaroo_2)  # -> area_3, area_4, R
abs_3 = Absolute(Value=error_evaluation.R)
total_error_area = Panel(abs_3)
area_unfolded = Panel(error_evaluation.area_3)
area_folded = Panel(error_evaluation.area_4)
abs_4 = Absolute(Value=total_error_area)
multiplication_9 = Multiplication(A=abs_4, B="100")
division_5 = Division(A=multiplication_9, B=area_unfolded)
tot_area_error = Panel(division_5)

# ----
# LENGTH ERROR EVALUATION
relaxed_cp_mesh_12 = Data(relaxed_cp_mesh_2)
# COLOUR
# PREVIEW
folded_mesh_kangaroo_3 = Mesh(folded_mesh_kangaroo)
py3_2 = Python3Script(mesh=relaxed_cp_mesh_12)  # -> edges; inputs mesh: Mesh; same code as meshedges
py3_3 = Python3Script(mesh=folded_mesh_kangaroo_3)  # -> edges; inputs mesh: Mesh; same code as meshedges
len_4 = Length(Curve=py3_3)
len_5 = Length(Curve=py3_2)
multiplication_10 = Multiplication(A=len_4, B="100")
division_6 = Division(A=multiplication_10, B=len_5)
subtraction = Subtraction(A=division_6, B="100")
bnd_4 = Bounds(Numbers=subtraction)
edge_error = Panel(bnd_4)

# ---- group: calculate baricentre, first orient the surface
# Find Baricentre
folded_mesh_kangaroo_4 = Mesh(folded_mesh_kangaroo)
Z = UnitZ(Factor=1)
area_4 = Area(Geometry=folded_mesh_kangaroo_4)  # -> Area, Centroid
xy = XYPlane(Origin=Point(0, 0, 0))
bbox = BoundingBox(Content=folded_mesh_kangaroo_4, Plane=PlaneXY(0, 0, 0))  # -> Box, Box_2
line_5 = LineSDL(Start=area_4.Centroid, Direction=Z, Length=1)
plx = LinePlane(Line=line_5, Plane=xy)  # -> Point, ParamL, ParamP
barycentre_on_xy = Data(plx.Point)

# ----
flat_mesh_edges = Curve(flat_creases_kangaroo)
barycentre_on_xy_2 = Data(barycentre_on_xy)
all_mesh_edges = Curve(all_mesh_edges_kangaroo)
mountain_creases = Curve(mountain_creases_kangaroo)
valley_creases = Curve(valley_creases_kangaroo)
unassigned_creases = Curve(unassigned_creases_kangaroo)
boundaries = Curve(boundaries_kangaroo)
preview_13 = CustomPreview(Geometry=mountain_creases, Material=swatch_2)
preview_14 = CustomPreview(Geometry=valley_creases, Material=ColourSwatch(SwatchColor=RGB(0, 42, 255)))
preview_15 = CustomPreview(Geometry=unassigned_creases, Material=ColourSwatch(SwatchColor=RGB(255, 0, 170)))
preview_16 = CustomPreview(Geometry=boundaries, Material=ColourSwatch(SwatchColor=RGB(0, 0, 0)))
preview_17 = CustomPreview(Geometry=flat_mesh_edges, Material=ColourSwatch(SwatchColor=RGB(135, 135, 135)))
preview_18 = CustomPreview(Geometry=barycentre_on_xy_2, Material=ColourSwatch(SwatchColor=RGB(255, 0, 0)))
preview_19 = CustomPreview(Geometry=all_mesh_edges, Material=ColourSwatch(SwatchColor=RGB(135, 135, 135)))

tot_area_error_2 = Panel(tot_area_error)
edge_error_2 = Panel(edge_error)
tot_iterations = Panel(solver.I)

mesh_with_soft_creases_welded = Data(folded_mesh_kangaroo)
preview_20 = CustomPreview(Geometry=mesh_with_soft_creases_welded, Material=material_2)

# ----
# Colour mesh by stretch
stretch_domain_slider = Data(stretch_domain_mmq)
relaxed_cp_mesh_13 = Data(relaxed_cp_mesh_2)
explode_18 = MeshExplode(Mesh=relaxed_cp_mesh_13, Interpolate=False)  # -> graft(Faces)
area_5 = Area(Geometry=explode_18)  # -> Area, Centroid
neg = Negative(Value=stretch_domain_slider)

# ----
# Unweld mesh edges on creases
folded_mesh_kangaroo_5 = Mesh(folded_mesh_kangaroo)
valley_creases_kangaroo_2 = Data(valley_creases_kangaroo)
mountain_creases_kangaroo_2 = Data(mountain_creases_kangaroo)
unassigned_creases_kangaroo_2 = Data(unassigned_creases_kangaroo)
merge_18 = Merge(Data1=mountain_creases_kangaroo_2, Data2=valley_creases_kangaroo_2, Data3=unassigned_creases_kangaroo_2)
all_creases = Data(merge_18)
explode_19 = Explode(Curve=all_creases, Recursive=True)  # -> Segments, Vertices
midpt_3 = CurveMiddle(Curve=explode_19.Segments)

py3_4 = Python3Script(mesh=folded_mesh_kangaroo_5)  # -> edges; inputs mesh: Mesh; same code as meshedges

midpt_4 = CurveMiddle(Curve=py3_4)
cp_3 = ClosestPoint(Point=midpt_3, Cloud=midpt_4)  # -> ClosestPoint, CPIndex, Distance
unweld_by_index = CSharpScript(M=folded_mesh_kangaroo_5, Ei=flatten(cp_3.CPIndex))  # -> Mo; inputs M: Mesh, Ei: list of Int32
# ---------- unweld_by_index: C# ----------
    M.UnweldEdge(Ei, true);
    M.RebuildNormals();
    Mo = M;
# ---------- end unweld_by_index ----------
folded_mesh_unwelded = Data(unweld_by_index)

folded_mesh_unwelded_2 = Data(folded_mesh_unwelded)

data_12 = Data(folded_mesh_unwelded_2)

folded_mesh_unwelded_3 = Mesh(folded_mesh_unwelded)
explode_20 = MeshExplode(Mesh=folded_mesh_unwelded_3, Interpolate=False)  # -> graft(Faces)
area_6 = Area(Geometry=explode_20)  # -> Area, Centroid
subtraction_2 = Subtraction(A=area_5.Area, B=area_6.Area)
multiplication_11 = Multiplication(A=subtraction_2, B="100")
division_7 = Division(A=multiplication_11, B=area_5.Area)
gradient = Gradient(
    LowerLimit=neg,
    UpperLimit=stretch_domain_slider,
    Parameter=division_7,
    stops=[0: RGB(255, 255, 0), 0: RGB(255, 255, 0), 0.498: RGB(46, 139, 87), 1: RGB(255, 0, 0), 1: RGB(255, 0, 0)])
bnd_5 = Bounds(Numbers=flatten(division_7))
dedomain_4 = DeconstructDomain(Domain=flatten(bnd_5))  # -> Start, End
mspray = MeshSpray(Mesh=folded_mesh_unwelded_3, Points=flatten(area_6.Centroid), Colours=flatten(gradient), SprayMode=11)
maximum_negative_deformation = Panel(dedomain_4.Start)
maximum_positive_deformation = Panel(dedomain_4.End)

face_error = Panel(bnd_5)

mesh_with_sharp_creases_unwelded = Data(folded_mesh_unwelded)
preview_21 = CustomPreview(Geometry=mesh_with_sharp_creases_unwelded, Material=material_2)
mesh_4 = Mesh(mspray)

# ==== cluster ExtractHingePoints
list_of_creases_crv = ClusterInput()
triangulated_cp_mesh = ClusterInput()
triangulated_cp_mesh_2 = Data(triangulated_cp_mesh)
list_of_creases_crv_2 = Data(list_of_creases_crv)

# ----
# Draw creases
# mid points
explode = Explode(Curve=list_of_creases_crv_2, Recursive=True)  # -> Segments, Vertices
evaluate_curve = EvaluateCurve(Curve=reparameterize(explode.Segments), Parameter=0.5)  # -> Point, Tangent, Angle

# ----
# Hinge points
# extraction
hingepoints = HingePoints(Mesh=triangulated_cp_mesh_2)  # -> _1, _2, _3, _4

# ----
# Draw hinges
# mid point
line = Line(StartPoint=hingepoints._1, EndPoint=hingepoints._2)
evaluate_curve_2 = EvaluateCurve(Curve=reparameterize(line), Parameter=0.5)  # -> Point, Tangent, Angle

# ----
# Find closest hinge
# for every crease
closest_point = ClosestPoint(Point=evaluate_curve.Point, Cloud=flatten(evaluate_curve_2.Point))  # -> ClosestPoint, CPIndex, Distance

# ---- group: restructure tree
flattened_tree = Data(flatten(closest_point.CPIndex))
ref_tree = Data(list_of_creases_crv_2)
list_length = ListLength(List=ref_tree)  # -> flatten(Length)
partition_list = PartitionList(List=flattened_tree, Size=list_length)
restructured_tree = Data(partition_list)
match_tree = MatchTree(Tree=restructured_tree, Guide=ref_tree)

# ----
# Filter Hinge points
# based on crease
# proximity
list_item = ListItem(List=hingepoints._1, Index=match_tree, Wrap=True)
list_item_2 = ListItem(List=hingepoints._2, Index=match_tree, Wrap=True)
list_item_3 = ListItem(List=hingepoints._3, Index=match_tree, Wrap=True)
list_item_4 = ListItem(List=hingepoints._4, Index=match_tree, Wrap=True)

fold_end = Data(list_item_2)
tip_1 = Data(list_item_3)
fold_start = Data(list_item)
tip_2 = Data(list_item_4)
match_tree_2 = MatchTree(Tree=tip_2, Guide=ref_tree)
match_tree_3 = MatchTree(Tree=tip_1, Guide=ref_tree)
match_tree_4 = MatchTree(Tree=fold_start, Guide=ref_tree)
match_tree_5 = MatchTree(Tree=fold_end, Guide=ref_tree)
tree = ClusterOutput(match_tree_4)
tree_2 = ClusterOutput(match_tree_5)
tree_3 = ClusterOutput(match_tree_3)
tree_4 = ClusterOutput(match_tree_2)

# ==== cluster ErrorEvaluation
geometry = ClusterInput()
geometry_2 = ClusterInput()
area = Area(Geometry=geometry)  # -> Area, Centroid
area_2 = Area(Geometry=geometry_2)  # -> Area, Centroid
abs = Absolute(Value=area.Area)
abs_2 = Absolute(Value=area_2.Area)
subtraction = Subtraction(A=abs, B=abs_2)
area_3 = ClusterOutput(area.Area)
area_4 = ClusterOutput(area_2.Area)
R = ClusterOutput(subtraction)

# ==== cluster TurnOffFold
value_to_maximize = ClusterInput()
value = ClusterInput()
boolean = ClusterInput()
merge = Merge(Data1=value_to_maximize, Data2=value)
item = ListItem(List=merge, Index=boolean, Wrap=True)
i = ClusterOutput(item)

# ==== cluster Cluster
relay = ClusterInput()
pt = Point(Point(0, 0, 0))
null = NullItem(Item=relay)  # -> NullFlags, InvalidFlags, Description
p_n_c = PickNChoose(Pattern=null.NullFlags, Stream0=relay, Stream1=pt)
relay_2 = ClusterOutput(p_n_c)

# ==== cluster Cluster_2
cutting_crvs = ClusterInput()
cutting_pts = ClusterInput()
crvs_to_cut = ClusterInput()
data = Data(cutting_pts)
data_2 = Data(cutting_crvs)
data_3 = Data(crvs_to_cut)
Z = UnitZ(Factor="2")
line = LineSDL(Start=flatten(data), Direction=Z, Length=Z)
Z_2 = UnitZ(Factor="-1")
move = Move(Geometry=line, Motion=Z_2)  # -> Geometry, Transform
merge = Merge(Data1=data_3, Data2=data_2, Data3=move.Geometry)  # -> flatten(Result)
mcx = MultipleCurves(Curves=reparameterize(merge))  # -> Points, IndexA, IndexB, ParamA, ParamB
graft = GraftTree(Tree=data_3, IncludeEmptyLists=True, IncludeNullItems=True)
disc = Discontinuity(Curve=data_3, Level=1)  # -> Points, Parameters
merge_2 = Merge(Data1=disc.Points, Data2=mcx.Points)  # -> flatten(Result)
crv_cp = CurveClosestPoint(Point=merge_2, Curve=reparameterize(graft(graft)))  # -> Point, Parameter, Distance
smaller = SmallerThan(FirstNumber=crv_cp.Distance, SecondNumber="0.001")  # -> SmallerThan, OrEqualTo
cull = CullPattern(List=merge_2, CullPattern=smaller.SmallerThan)
cullpt = CullDuplicates(Points=cull, Tolerance=0.1, CullMode=3)  # -> Points, Indices, Valence
crv_cp_2 = CurveClosestPoint(Point=cullpt.Points, Curve=reparameterize(graft))  # -> Point, Parameter, Distance
panel = Panel("""0
1""")
null = NullItem(Item=crv_cp_2.Parameter)  # -> NullFlags, InvalidFlags, Description
eval = EvaluateCurve(Curve=reparameterize(graft), Parameter=panel)  # -> Point, Tangent, Angle
crv_cp_3 = CurveClosestPoint(Point=eval.Point, Curve=reparameterize(graft))  # -> Point, Parameter, Distance
p_n_c = PickNChoose(Pattern=null.NullFlags, Stream0=crv_cp_2.Parameter, Stream1=crv_cp_3.Parameter)
num = Number(p_n_c)
shatter = Shatter(Curve=reparameterize(graft), Parameters=num)  # -> simplify(Segments)
clean = CleanTree(RemoveNulls=True, RemoveInvalid=True, RemoveEmpty=True, Tree=shatter)
shattered_crvs = ClusterOutput(clean)

# ==== cluster RetrieveFoldAmount
creases = ClusterInput()
creases_2 = Data(simplify(creases))
data = Data(creases_2)
user_text = UserText(Content=data, UserTextMode=2)  # -> Content, Keys, Values
list_length = ListLength(List=user_text.Values)
smaller_than = SmallerThan(FirstNumber=list_length, SecondNumber="1")  # -> SmallerThan, OrEqualTo
pick_n_choose = PickNChoose(Pattern=smaller_than.SmallerThan, Stream0=user_text.Values, Stream1="1")
fold_amount = Data(pick_n_choose)
fold_amount_2 = ClusterOutput(fold_amount)

# ==== cluster Cluster_3
time = ClusterInput()
time_limit = ClusterInput()
delay = ClusterInput()
value = ClusterInput()
total_time = ClusterInput()
time_2 = Data(time)
time_limit_2 = Data(time_limit)
delay_2 = Data(delay)
value_2 = Data(value)
total_time_2 = Data(total_time)
smaller_than = SmallerThan(FirstNumber=time_2, SecondNumber=delay_2)  # -> SmallerThan, OrEqualTo
pick_n_choose = PickNChoose(Pattern=smaller_than.SmallerThan, Stream0=value_2, Stream1="0")
delayed_value = Data(pick_n_choose)
total_time_3 = Data(total_time_2)
time_limit_3 = Data(time_limit_2)
bounds = Bounds(Numbers=[time_limit_3, total_time_3])
deconstruct_domain = DeconstructDomain(Domain=bounds)  # -> Start, End
remap_numbers = RemapNumbers(Value=time_2, Source=deconstruct_domain.End, Target=delayed_value)  # -> Mapped, Clipped
delayed_value_2 = Data(remap_numbers.Mapped)
delayed_value_3 = ClusterOutput(delayed_value_2)

# ==== cluster Cluster_4
time = ClusterInput()
total_time = ClusterInput()
time_limit = ClusterInput()
delay = ClusterInput()
value = ClusterInput()
time_2 = Data(time)
time_limit_2 = Data(time_limit)
delay_2 = Data(delay)
value_2 = Data(value)
total_time_2 = Data(total_time)
smaller_than = SmallerThan(FirstNumber=time_2, SecondNumber=delay_2)  # -> SmallerThan, OrEqualTo
pick_n_choose = PickNChoose(Pattern=smaller_than.SmallerThan, Stream0=value_2, Stream1="1")
delayed_value = Data(pick_n_choose)
time_limit_3 = Data(time_limit_2)
total_time_3 = Data(total_time_2)
bounds = Bounds(Numbers=[time_limit_3, total_time_3])
deconstruct_domain = DeconstructDomain(Domain=bounds)  # -> Start, End
remap_numbers = RemapNumbers(Value=time_2, Source=deconstruct_domain.End, Target=delayed_value)  # -> Mapped, Clipped
delayed_value_2 = Data(remap_numbers.Mapped)
delayed_value_3 = ClusterOutput(delayed_value_2)
